# Grasshopper definition Maths_Trig.ghx (Grasshopper 1.0.7)

x = Slider(5, range=0..10)
sin = Sine(Value=x)
gh_sin = CSharpScript(x=x)  # -> out, y; inputs x: Double
# ---------- gh_sin: C# ----------
    // Component written by @erinlinseyhunt

    // Sin
    y = Math.Sin(x);
# ---------- end gh_sin ----------
panel = Panel(gh_sin.y)
panel_2 = Panel(sin)

# ----
# GH#: A C# dictionary of Grasshopper3D components.
# 
# This file contains a category of Grasshopper components, and a mirroring C#/RhinoCommon implementation.
# 
# This is an educational project initiated by students/faculty of GSD-6338: Introduction to Computational Design, at the Harvard Graduate School of Design.
# 
# More information: {{project link}}
# Maths Trig
x_2 = Slider(4, range=0..10)
cos = Cosine(Value=x_2)
gh_cos = CSharpScript(x=x_2)  # -> out, y; inputs x: Double
# ---------- gh_cos: C# ----------
    // Component written by @erinlinseyhunt

    // Cos
    y = Math.Cos(x);
# ---------- end gh_cos ----------
panel_3 = Panel(cos)
panel_4 = Panel(gh_cos.y)

x_3 = Slider(1, range=-1..1)
acos = ArcCosine(Value=x_3)
gh_acos = CSharpScript(x=x_3)  # -> out, y; inputs x: Double
# ---------- gh_acos: C# ----------
    // Component written by @erinlinseyhunt

    // Arccosine
    y = Math.Acos(x);
# ---------- end gh_acos ----------
panel_5 = Panel(acos)
panel_6 = Panel(gh_acos.y)

x_4 = Slider(5, range=0..10)
atan = ArcTangent(Value=x_4)
gh_atan = CSharpScript(x=x_4)  # -> out, y; inputs x: Double
# ---------- gh_atan: C# ----------
    // Component written by @erinlinseyhunt

    // Atan
    y = Math.Atan(x);
# ---------- end gh_atan ----------
panel_7 = Panel(atan)
panel_8 = Panel(gh_atan.y)

x_5 = Slider(5, range=0..10)
cot = CoTangent(Value=x_5)
gh_cot = CSharpScript(x=x_5)  # -> out, y; inputs x: Double
# ---------- gh_cot: C# ----------
    // Component written by @erinlinseyhunt

    // Cotangent
    y = 1 / Math.Tan(x);
# ---------- end gh_cot ----------
panel_9 = Panel(cot)
panel_10 = Panel(gh_cot.y)

number_slider = Slider(8, range=0..10)
deg = Degrees(Radians=number_slider)
gh_deg = CSharpScript(R=number_slider)  # -> out, D; inputs R: Double
# ---------- gh_deg: C# ----------
    // Component written by @erinlinseyhunt

    // Angle input in Degrees
    double radians = R;

    // Converts the angle from Degrees to Radians
    double degree = (180 / Math.PI) * radians;

    // Output
    D = degree;
# ---------- end gh_deg ----------
panel_11 = Panel(deg)
panel_12 = Panel(gh_deg.D)

rtrig = RightTrigonometry()  # -> Alpha, Beta, PLength, QLength, RLength

centroid = Centroid()  # -> Centroid, MedianAB, MedianBC, MedianCA
gh_centroid = CSharpScript()  # -> Out, C, AB, BC, CA

icentre = Incentre()  # -> Incentre, BisectorA, BisectorB, BisectorC
gh_icentre = CSharpScript()  # -> Out, I, A, B, C

x_6 = Slider(2, range=0..10)
sinc = Sinc(Value=x_6)
gh_sinc = CSharpScript(x=x_6)  # -> out, y; inputs x: Double
# ---------- gh_sinc: C# ----------
    // Component written by @erinlinseyhunt

    // Sinc
    y = Math.Sin(x) / x;
# ---------- end gh_sinc ----------
panel_13 = Panel(sinc)
panel_14 = Panel(gh_sinc.y)

x_7 = Slider(5, range=0..10)
tan = Tangent(Value=x_7)
gh_tan = CSharpScript(x=x_7)  # -> out, y; inputs x: Double
# ---------- gh_tan: C# ----------
    // Component written by @erinlinseyhunt

    // Tan
    y = Math.Tan(x);
# ---------- end gh_tan ----------
panel_15 = Panel(tan)
panel_16 = Panel(gh_tan.y)

x_8 = Slider(4, range=0..10)
sec = Secant(Value=x_8)
gh_sec = CSharpScript(x=x_8)  # -> out, y; inputs x: Double
# ---------- gh_sec: C# ----------
    // Component written by @erinlinseyhunt

    // Secant
    y = 1 / Math.Cos(x);
# ---------- end gh_sec ----------
panel_17 = Panel(sec)
panel_18 = Panel(gh_sec.y)

number_slider_2 = Slider(1, range=0..10)
rad = Radians(Degrees=number_slider_2)
gh_rad = CSharpScript(D=number_slider_2)  # -> out, R; inputs D: Double
# ---------- gh_rad: C# ----------
    // Component written by @erinlinseyhunt

    // Angle input in Degrees
    double degree = D;

    // Converting the angle from Degrees to Radians
    double radians = Math.PI * (degree / 180.00);

    // Output
    R = radians;
# ---------- end gh_rad ----------
panel_19 = Panel(rad)
panel_20 = Panel(gh_rad.R)

x_9 = Slider(1, range=0..10)
asin = ArcSine(Value=x_9)
gh_asin = CSharpScript(x=x_9)  # -> out, y; inputs x: Double
# ---------- gh_asin: C# ----------
    // Component written by @erinlinseyhunt

    // Arcsine
    y = Math.Asin(x);
# ---------- end gh_asin ----------
panel_21 = Panel(gh_asin.y)
panel_22 = Panel(asin)

x_10 = Slider(6, range=0..10)
csc = CoSecant(Value=x_10)
gh_csc = CSharpScript(x=x_10)  # -> out, y; inputs x: Double
# ---------- gh_csc: C# ----------
    // Component written by @erinlinseyhunt

    // Cosecant
    y = 1 / Math.Sin(x);
# ---------- end gh_csc ----------
panel_23 = Panel(gh_csc.y)
panel_24 = Panel(csc)

trig = TriangleTrigonometry()  # -> Alpha, Beta, Gamma, ALength, BLength, CLength

ccentre = Circumcentre()  # -> Circumcentre, BisectorAB, BisectorBC, BisectorCA
gh_ccentre = CSharpScript()  # -> Out, C, AB, BC, CA

ocentre = Orthocentre()  # -> Orthocentre, AltitudeAB, AltitudeBC, AltitudeCA
gh_ocentre = CSharpScript()  # -> Out, C, AB, BC, CA
