# Grasshopper definition Vector_Grid.ghx (Grasshopper 1.0.7)

# ---- group: Square
number_slider = Slider(3, range=0..100)
number_slider_2 = Slider(20, range=0..100)
number_slider_3 = Slider(20, range=0..100)
pln = Plane(PlaneXY(6.002839061, 8.575233017, 0))
gh_sqgrid = CSharpScript(P=pln, S=number_slider, Ex=number_slider_2, Ey=number_slider_3)  # -> out, C, Pout; inputs P: Plane, S: Double, Ex: Int32, Ey: Int32
# ---------- gh_sqgrid: C# ----------
    // Component written by @krichterlunn & @garciadelcastillo

    // This component creates a square grid of curves.
    // TODO: make the DataTree branches mimic the input structure.

    // Creating variables for you x and y plan origin
    // This you to move your plane and maintain the same relationship
    double iPX = P.OriginX;
    double iPY = P.OriginY;

    // Declare your new lists which you will be creating (pointrectangle)
    DataTree<Point3d> pts = new DataTree<Point3d>();
    DataTree<Rectangle3d> rectangle = new DataTree<Rectangle3d>();

    // Creating your points using two for loops.
    // First loop runs through all your columns for x and multiplies it by your value Sx (input value).
    // Second loop runs through all your rows for y and multiplies it by your value Sy (input value).
    // These points are then oriented to the plane iPx and iPy which we declared at the begining.
    for (int i = 0; i < Ex + 1; i++)
    {
      double x = i * S;
      GH_Path path = new GH_Path(i);

      for (int j = 0; j < Ey + 1; j++)
      {
        double y = j * S;

        pts.Add(new Point3d(x + iPX, y + iPY, 0.0), path); // new points(x,y,z)
      }
    }
    
    // This loop runs through all the points we created above (except last ones per row and column),
    // and creates a new plane at each point.
    // From those planes we are then able to create our rectangles with take (plane, x, y) as its input.
    for (int i = 0; i < pts.BranchCount - 1; i++)
    {
      List<Point3d> column = pts.Branches[i];
      GH_Path path = pts.Paths[i];

      for (int j = 0; j < column.Count - 1; j++)
      {
        Plane tempP = new Plane(P);
        tempP.Origin = column[j];
        Rectangle3d rec = new Rectangle3d(tempP, S, S);
        rectangle.Add(rec, path);
      }
    }

    // Output
    Pout = pts;
    C = rectangle;
# ---------- end gh_sqgrid ----------
sqgrid = Square(Plane=pln, Size=number_slider, ExtentX=number_slider_2, ExtentY=number_slider_3)  # -> Cells, Points
panel = Panel(sqgrid.Cells)
panel_2 = Panel(sqgrid.Points)
panel_3 = Panel(gh_sqgrid.C)
panel_4 = Panel(gh_sqgrid.Pout)

# ---- group: Rectangular
number_slider_4 = Slider(6, range=0..100)
number_slider_5 = Slider(7, range=0..100)
number_slider_6 = Slider(20, range=0..100)
number_slider_7 = Slider(17, range=0..100)
pln_2 = Plane(PlaneXY(6.002839061, 8.575233017, 0))
gh_recgrid = CSharpScript(P=pln_2, Sx=number_slider_4, Sy=number_slider_5, Ex=number_slider_6, Ey=number_slider_7)  # -> out, C, Pout; inputs P: Plane, Sx: Double, Sy: Double, Ex: Int32, Ey: Int32
# ---------- gh_recgrid: C# ----------
    // Component written by @krichterlunn & @garciadelcastillo

    // This component creates a rectangular grid of curves.
    // TODO: make the DataTree branches mimic the input structure.

    // Creating variables for you x and y plan origin
    // This you to move your plane and maintain the same relationship
    double iPX = P.OriginX;
    double iPY = P.OriginY;

    // Declare your new lists which you will be creating (point, rectangle)
    DataTree<Point3d> pts = new DataTree<Point3d>();
    DataTree<Rectangle3d> rectangle = new DataTree<Rectangle3d>();

    // Creating your points using two for loops.
    // First loop runs through all your columns for x and multiplies it by your value Sx (input value).
    // Second loop runs through all your rows for y and multiplies it by your value Sy (input value).
    // These points are then oriented to the plane iPx and iPy which we declared at the begining.
    for (int i = 0; i < Ex + 1; i++)
    {
      double x = i * Sx;
      GH_Path path = new GH_Path(i);
      
      for (int j = 0; j < Ey + 1; j++)
      {
        double y = j * Sy;
      
        pts.Add(new Point3d(x + iPX, y + iPY, 0.0), path); // new points(x,y,z)
      }
    }

    // This loop runs through all the points we created above (except last ones per row and column),
    // and creates a new plane at each point.
    // From those planes we are then able to create our rectangles with take (plane, x, y) as its input.
    for (int i = 0; i < pts.BranchCount - 1; i++)
    {
      List<Point3d> column = pts.Branches[i];
      GH_Path path = pts.Paths[i];
      
      for (int j = 0; j < column.Count - 1; j++)
      {
        Plane tempP = new Plane(P);
        tempP.Origin = column[j];
        Rectangle3d rec = new Rectangle3d(tempP, Sx, Sy);
        rectangle.Add(rec, path);
      }
    }

    // Output
    Pout = pts;
    C = rectangle;
# ---------- end gh_recgrid ----------
recgrid = Rectangular(Plane=pln_2, SizeX=number_slider_4, SizeY=number_slider_5, ExtentX=number_slider_6, ExtentY=number_slider_7)  # -> Cells, Points
panel_5 = Panel(recgrid.Cells)
panel_6 = Panel(recgrid.Points)
panel_7 = Panel(gh_recgrid.C)
panel_8 = Panel(gh_recgrid.Pout)

# ---- group: Hexagonal
# GH#: A C# dictionary of Grasshopper3D components.
# 
# This file contains a category of Grasshopper components, and a mirroring C#/RhinoCommon implementation.
# 
# This is an educational project initiated by students/faculty of GSD-6338: Introduction to Computational Design, at the Harvard Graduate School of Design.
# 
# More information: {{project link}}
# Vector Grid
number_slider_8 = Slider(6, range=0..100)
number_slider_9 = Slider(10, range=0..100)
number_slider_10 = Slider(11, range=0..100)
pln_3 = Plane(PlaneXY(6.002839061, 8.575233017, 0))
gh_hexgrid = CSharpScript(P=pln_3, S=number_slider_8, Ex=number_slider_9, Ey=number_slider_10)  # -> out, C, Pout; inputs P: Plane, S: Double, Ex: Int32, Ey: Int32
# ---------- gh_hexgrid: C# ----------
    // Component written by @krichterlunn & @garciadelcastillo

    // This component creates a hexagonal grid of curves.
    // TODO: make the DataTree branches mimic the input structure.

    // Creating variables for you x and y plan origin
    // This you to move your plane and maintain the same relationship
    double iPX = P.OriginX;
    double iPY = P.OriginY;

    // Declare your new lists which you will be creating (point, line, plane, circle, polyline)
    DataTree<Point3d> pts = new DataTree<Point3d>();
    DataTree<Polyline> hexagons = new DataTree<Polyline>();

    // Here you create your center points from which you can create your cirlces and hexagons
    // running through two loops: one for your columns and one for your rows. You can then determine the
    // spacing and position of each point based on equations related to the hexagon.

    for (int i = 0; i < Ex; i++)
    {
      double x = 1.5 * S * i + iPX;
      GH_Path path = new GH_Path(i);

      for (int j = 0; j < Ey; j++)
      {
        double y = 3 * S * Math.Tan(Math.PI / 6.0) * j + iPY;
        if (i % 2 == 1)
        {
          y += 1.5 * S * Math.Tan(Math.PI / 6.0);
        }

        Point3d pt = new Point3d(x, y, 0.0);
        pts.Add(pt, path);
      }
    }


    // For each point you will now oriente a new plane at that point.
    // This will allow you to construct a circle and then a polygon at those points.
    for (int i = 0; i < pts.BranchCount; i++)
    {
      List<Point3d> row = pts.Branches[i];
      GH_Path path = pts.Paths[i];
      for (int j = 0; j < row.Count; j++)
      {
        Plane tempP = new Plane(P);
        tempP.Origin = row[j];
        Circle circ = new Circle(tempP, S);
        Polyline hex = Polyline.CreateInscribedPolygon(circ, 6);
        hexagons.Add(hex, path);
      }
    }

    // Output
    Pout = pts;
    C = hexagons;
# ---------- end gh_hexgrid ----------
hexgrid = Hexagonal(Plane=pln_3, Size=number_slider_8, ExtentX=number_slider_9, ExtentY=number_slider_10)  # -> Cells, Points
panel_9 = Panel(hexgrid.Cells)
panel_10 = Panel(hexgrid.Points)
panel_11 = Panel(gh_hexgrid.C)
panel_12 = Panel(gh_hexgrid.Pout)

# ----
number_slider_11 = Slider(51, range=0..1000)
number_slider_12 = Slider(3, range=0..10)
rec = Rectangle({Plane=PlaneXY(16.52941808, 22.96342887, 0), Size=Domain2(u=-12.16496808..12.16496808, v=-19.19207777..19.19207777)})
gh_pop2d = CSharpScript(R=rec, N=number_slider_11, S=number_slider_12)  # -> out, P; inputs R: Box, N: Double, S: Int32
# ---------- gh_pop2d: C# ----------
    // Component written by @krichterlunn and @mirahx24

    this.Component.AddRuntimeMessage(GH_RuntimeMessageLevel.Warning, "Random pattern differs from the original");

    // Create List of points to hold random points
    List<Point3d> pts = new List<Point3d>();

    // Random is a native C# class
    // We can initialize it with a seed
    // Create random float numbers by creating two number -- one is the integer and one is the remainder -- and combine them into one
    Random random = new Random(S);

    for(int i = 0; i < N; i++){
      double x = random.Next(Convert.ToInt32(R.X.Min), Convert.ToInt32(R.X.Max)); // integer part
      double xRemain = random.NextDouble(); // remainder part
      x += xRemain;
      double y = random.Next(Convert.ToInt32(R.Y.Min), Convert.ToInt32(R.Y.Max)); // integer part
      double yRemain = random.NextDouble(); // remainder part
      y += yRemain;

      // Create new points using the x and y values and add it to the list of points
      pts.Add(new Point3d(x, y, 0.0));
    }

    // Output
    P = pts;
# ---------- end gh_pop2d ----------
pop2d = Populate2D(Region=rec, Count=number_slider_11, Seed=number_slider_12)
panel_13 = Panel(gh_pop2d.P)
panel_14 = Panel(pop2d)

number_slider_13 = Slider(51, range=0..1000)
number_slider_14 = Slider(3, range=0..10)
brep = Brep(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)
gh_pop3d = CSharpScript(R=brep, N=number_slider_13, S=number_slider_14)  # -> out, P; inputs R: Box, N: Double, S: Int32
# ---------- gh_pop3d: C# ----------
    // Component written by @krichterlunn and @mirahx24
    
    this.Component.AddRuntimeMessage(GH_RuntimeMessageLevel.Warning, "Random pattern differs from the original");

    // Create List of points to hold randon points
    List<Point3d> pts = new List<Point3d>();

    // Random is a native C# class
    // We can initialize it with a seed
    // Create random float numbers by creating two number -- one is the integer and one is the remainder -- and combine them into one
    Random random = new Random(S);

    for(int i = 0; i < N; i++){
      double x = random.Next(Convert.ToInt32(R.X.Min), Convert.ToInt32(R.X.Max)); // x integer
      double xRemain = random.NextDouble(); // x remainder
      x += xRemain;
      double y = random.Next(Convert.ToInt32(R.Y.Min), Convert.ToInt32(R.Y.Max)); // y integer
      double yRemain = random.NextDouble(); // y remainder
      y += yRemain;
      double z = random.Next(Convert.ToInt32(R.Z.Min), Convert.ToInt32(R.Z.Max)); // z integer
      double zRemain = random.NextDouble(); // z remainder
      z += zRemain;

      // Create new points using the x, y, and z values and add it to the list of points
      pts.Add(new Point3d(x, y, z));
    }

    // Output
    P = pts;
# ---------- end gh_pop3d ----------
pop3d = Populate3D(Region=brep, Count=number_slider_13, Seed=number_slider_14)
panel_15 = Panel(pop3d)
panel_16 = Panel(gh_pop3d.P)

radgrid = Radial(Plane=PlaneXY(0, 0, 0), Size=1, ExtentR=5, ExtentP=20)  # -> Cells, Points
gh_radgrid = CSharpScript()  # -> Out, C, Pout

trigrid = Triangular(Plane=PlaneXY(0, 0, 0), Size=1, ExtentX=5, ExtentY=5)  # -> Cells, Points
gh_trigrid = CSharpScript()  # -> Out, C, Pout

gh_popgeo = CSharpScript()  # -> Out, Pout
popgeo = PopulateGeometry(Count=100, Seed=1)
