# Grasshopper definition Vector_Plane.ghx (Grasshopper 1.0.7)

Z = UnitZ(Factor=1)
pln = Plane(Plane(origin=(19, 6, 0), x=(0.6178215519, 0.7863183388, 0), y=(0.7099357833, -0.5578066869, 0.4299335804)))
yz = YZPlane(Origin=Point(0, 0, 0))
number_slider = Slider(3, range=0..10)
yz_2 = YZPlane(Origin=Point(0, 0, 0))
xy = XYPlane(Origin=Point(0, 0, 0))
yz_3 = YZPlane(Origin=Point(0, 0, 0))
yz_4 = YZPlane(Origin=Point(0, 0, 0))
pln_2 = Plane(Plane(origin=(19, 6, 0), x=(0.6178215519, 0.7863183388, 0), y=(0.7099357833, -0.5578066869, 0.4299335804)))
yz_5 = YZPlane(Origin=Point(0, 0, 0))
pln_3 = Plane(Plane(origin=(6, 5, 0), x=(0.5368754922, -0.8436614877, 0), y=(0.6305604577, 0.4012657458, -0.6643638388)))

xy_2 = XYPlane(Origin=Point(0, 0, 0))
pln_4 = Plane([Plane(origin=(-18.00867755, 8.094398381, 0), x=(0.6693414041, 0.7429549682, 0), y=(0, 0, 1)), Plane(origin=(-15.60908894, 6.017764458, 0), x=(0.6402538266, 0.7681634185, 0), y=(0, 0, 1)), Plane(origin=(-13.13702255, 4.02789191, 0), x=(0.6137683, 0.7894862088, 0), y=(0, 0, 1)), Plane(origin=(-10.59743953, 2.124981747, 0), x=(0.5844139317, 0.8114557021, 0), y=(0, 0, 1)), Plane(origin=(-7.979564921, 0.3315971985, 0), x=(0.5419800382, 0.8403913602, 0), y=(0, 0, 1)), Plane(origin=(-5.24266772, -1.272687082, 0), x=(0.4613547686, 0.8872157446, 0), y=(0, 0, 1))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])
c_align = CSharpScript(P=pln_4, M=xy_2)  # -> out, Pl; inputs P: Plane, M: Plane
# ---------- c_align: C# ----------
    //Component written by @krichterlunn

    //List<Plane> Pl2 = new List<Plane>();

    P.Rotate(Vector3d.VectorAngle(P.XAxis, M.Normal, P), P.ZAxis);

    //need to output list....
    Pl = P;
# ---------- end c_align ----------
# Same
panel = Panel(c_align.Pl)

# ---- group: Grasshopper Align
align = AlignPlanes(Planes=pln_4, Master=xy_2)

# ----
panel_2 = Panel(align)

# ----
# not Same?
pln_5 = Plane(align)
pln_6 = Plane(c_align.Pl)

X = UnitX(Factor=1)
c_padjust = CSharpScript(P=pln, N=X)  # -> out, Pl; inputs P: Plane, N: Vector3d
# ---------- c_padjust: C# ----------
    //Component written by @krichterlunn

    //Adjust plane normal direction to N
    Pl = new Plane(P.Origin, N);
# ---------- end c_padjust ----------
panel_3 = Panel(c_padjust.Pl)

# ---- group: Grasshopper PAdjust
padjust = AdjustPlane(Plane=pln, Normal=X)

# ----
panel_4 = Panel(padjust)

angle = Slider(45, range=0..360)
xy_3 = XYPlane(Origin=Point(0, 0, 0))
c_prot = CSharpScript(P=xy_3, A=angle)  # -> out, Pl; inputs P: Plane, A: Double
# ---------- c_prot: C# ----------
    //Component written by @krichterlunn

    //rotate a plane around angle A and axis from plane P
    P.Rotate(A, P.Normal);
    
    //output new plane
    Pl = P;
# ---------- end c_prot ----------
panel_5 = Panel(c_prot.Pl)

# ---- group: Grasshopper PRot
prot = RotatePlane(Plane=xy_3, Angle=angle)

# ----
panel_6 = Panel(prot)

pt = Point(Point(5.409136367, -2.140998851, 0))
xy_4 = XYPlane(Origin=Point(0, 0, 0))
c_cp = CSharpScript(S=pt, P=yz)  # -> out, Pt, uv, D; inputs S: Point3d, P: Plane
# ---------- c_cp: C# ----------
    //Component written by @krichterlunn

    //find closest parameters to plane P
    double U;
    double V;
    P.ClosestParameter(S, out U, out V);

    //output closest point, new point uv coordinates, and Plane distance to S
    Pt = P.ClosestPoint(S);
    uv = new Point3d(U, V, 0.0);
    D = P.DistanceTo(S);
# ---------- end c_cp ----------
panel_7 = Panel(c_cp.Pt)
panel_8 = Panel(c_cp.uv)
panel_9 = Panel(c_cp.D)

# ---- group: Grasshopper CP
cp = PlaneClosestPoint(Point=pt, Plane=yz)  # -> Point, UVPoint, Distance

# ----
panel_10 = Panel(cp.Point)

panel_11 = Panel(cp.UVPoint)
panel_12 = Panel(cp.Distance)

pt_2 = Point(Point(5.928926226, 17.76513586, 0))
X_2 = Slider(1, range=1..5)
Y = Slider(1, range=1..5)
X_3 = UnitX(Factor=X_2)
Y_2 = UnitY(Factor=Y)
c_pl = CSharpScript(O=pt_2, X=X_3, Y=Y_2)  # -> out, Pl; inputs O: Point3d, X: Vector3d, Y: Vector3d
# ---------- c_pl: C# ----------
    // Component written by @krichterlunn

    // This component constructs a plane from an Origin point "O" and the input X and Y axis
    Plane newpl = new Plane(O, X, Y);

    // Output plane
    Pl = newpl;
# ---------- end c_pl ----------
panel_13 = Panel(c_pl.Pl)

# ---- group: Grasshopper Pl
pl = ConstructPlane(Origin=pt_2, XAxis=X_3, YAxis=Y_2)

# ----
panel_14 = Panel(pl)

pt_3 = Point(Point(-8.200616191, 1.956036226, 0))
c_xz = CSharpScript(O=pt_3)  # -> out, P; inputs O: Point3d
# ---------- c_xz: C# ----------
    // Component written by @krichterlunn

    // This component sets two new vectors: one in the X direction and one in the Z direction
    // We then construct our new plane with Origine "O" and vectors X and Z
    Vector3d xVector = new Vector3d(1, 0, 0);
    Vector3d zVector = new Vector3d(0, 0, 1);
    Plane newXZ = new Plane(O, xVector, zVector);
    P = newXZ;
# ---------- end c_xz ----------
panel_15 = Panel(c_xz.P)

# ---- group: Grasshopper XZ
xz = XZPlane(Origin=pt_3)

# ----
panel_16 = Panel(xz)

crv = Curve(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)
pt_4 = Point(Point(6.70516853, 0, 4.333694603))
c_lnpt = CSharpScript(L=crv, P=pt_4)  # -> out, Pl; inputs L: Line, P: Point3d
# ---------- c_lnpt: C# ----------
    // Component written by @krichterlunn

    // Vector x using start and end points of Line L
    Vector3d x = L.To - L.From;
    x.Unitize();

    // Vector y from Point3d P and end point of Line L
    Vector3d direction = L.To - P;
    Vector3d z = Vector3d.CrossProduct(x, direction);
    z.Unitize();
    Vector3d y = Vector3d.CrossProduct(z, x);

    // Construct new plane with origin = L.from, and x, y vectors
    Plane newpl = new Plane(L.From, x, y);

    // Output
    Pl = newpl;
# ---------- end c_lnpt ----------
panel_17 = Panel(c_lnpt.Pl)

# ---- group: Grasshopper LnPt
lnpt = LinePt(Line=crv, Point=pt_4)

# ----
panel_18 = Panel(lnpt)

# ----
# GH#: A C# dictionary of Grasshopper3D components.
# 
# This file contains a category of Grasshopper components, and a mirroring C#/RhinoCommon implementation.
# 
# This is an educational project initiated by students/faculty of GSD-6338: Introduction to Computational Design, at the Harvard Graduate School of Design.
# 
# More information: {{project link}}
# Vector Plane
xy_5 = XYPlane(Origin=Point(0, 0, 0))
c_deplane = CSharpScript(P=xy_5)  # -> out, O, X, Y, Z; inputs P: Plane
# ---------- c_deplane: C# ----------
    // Component written by @krichterlunn

    // This component outputs the Origin (O) of a plane, and its X, Y, Z Axis
    O = P.Origin;
    X = P.XAxis;
    Y = P.YAxis;
    Z = P.ZAxis;
# ---------- end c_deplane ----------
panel_19 = Panel(c_deplane.O)
panel_20 = Panel(c_deplane.X)
panel_21 = Panel(c_deplane.Y)
panel_22 = Panel(c_deplane.Z)

# ---- group: Grasshopper DePlane
deplane = DeconstructPlane(Plane=xy_5)  # -> Origin, XAxis, YAxis, ZAxis

# ----
panel_23 = Panel(deplane.Origin)
panel_24 = Panel(deplane.XAxis)
panel_25 = Panel(deplane.YAxis)
panel_26 = Panel(deplane.ZAxis)

xy_6 = XYPlane(Origin=Point(0, 0, 0))

# ---- group: C# PI Offset
c_pl_offset = CSharpScript(P=xy_6, O=number_slider)  # -> out, Pl; inputs P: Plane, O: Double
# ---------- c_pl_offset: C# ----------
    //Component written by @krichterlunn

    // offset plane based on normal vector and distance O
    Vector3d offset = P.Normal * O;
    P.Translate(offset);

    //outputs
    Pl = P;
# ---------- end c_pl_offset ----------

# ---- group: Grasshopper Pl Offset
pl_offset = PlaneOffset(BasePlane=xy_6, Offset=number_slider)

# ----
panel_27 = Panel(pl_offset)
panel_28 = Panel(c_pl_offset.Pl)

pt_5 = Point([Point(-4.410231517, 4.10049347, -0.4515786429), Point(-3.325425288, -3.660053115, -1.111724532), Point(0.4898677026, -8.21495467, -0.860767574), Point(3.197213163, -7.166596062, 0), Point(2.179369692, -3.464424299, 1.015360714), Point(0.8730516958, 3.257894835, 0), Point(4.998037723, -0.01889610073, 1.820520159), Point(4.442070263, 2.40760673, 0), Point(6.555356326, -2.586465397, 0)])
c_plfit = CSharpScript(P=pt_5)  # -> out, Pl, dx; inputs P: list of Point3d
# ---------- c_plfit: C# ----------
    //Component written by @krichterlunn

    // fit a plane through an input list of Point3d
    Plane pl2;
    double Maxd;
    Plane.FitPlaneToPoints(P, out pl2, out Maxd);

    // output Plane and max deviation
    Pl = pl2;
    dx = Maxd;
# ---------- end c_plfit ----------
panel_29 = Panel(c_plfit.dx)

# ---- group: Grasshopper PlFit
plfit = PlaneFit(Points=pt_5)  # -> Plane, Deviation

# ----
panel_30 = Panel(c_plfit.Pl)

panel_31 = Panel(plfit.Deviation)
panel_32 = Panel(plfit.Plane)

pt_6 = Point(Point(-8.200616191, 1.956036226, 0))
c_yz = CSharpScript(O=pt_6)  # -> out, P; inputs O: Point3d
# ---------- c_yz: C# ----------
    // Component written by @krichterlunn

    // This component sets two new vectors: one in the Y direction and one in the Z direction
    // We then construct our new plane with Origine "O" and vectors Y and Z
    Vector3d yVector = new Vector3d(0, 1, 0);
    Vector3d zVector = new Vector3d(0, 0, 1);
    Plane newYZ = new Plane(O, yVector, zVector);
    P = newYZ;
# ---------- end c_yz ----------
panel_33 = Panel(c_yz.P)

# ---- group: Grasshopper YZ
yz_6 = YZPlane(Origin=pt_6)

# ----
panel_34 = Panel(yz_6)

pt_7 = Point(Point(-8.200616191, 1.956036226, 0))
c_xy = CSharpScript(O=pt_7)  # -> out, P; inputs O: Point3d
# ---------- c_xy: C# ----------
    // Component written by @krichterlunn

    // This component sets two new vectors: one in the X direction and one in the Y direction
    // We then construct our new plane with Origine "O" and vectors X and Y
    Vector3d xVector = new Vector3d(1, 0, 0);
    Vector3d yVector = new Vector3d(0, 1, 0);
    Plane newXY = new Plane(O, xVector, yVector);
    P = newXY;
# ---------- end c_xy ----------
panel_35 = Panel(c_xy.P)

# ---- group: Grasshopper XY
xy_7 = XYPlane(Origin=pt_7)

# ----
panel_36 = Panel(xy_7)

pt_8 = Point(Point(2.022902763, -2.775234427, 0))
pt_9 = Point(Point(2.149540586, 2.849301367, 0))
pt_10 = Point(Point(5.771559159, -6.59850313, 0))
c_pl_3pt = CSharpScript(A=pt_8, B=pt_9, C=pt_10)  # -> out, Pl; inputs A: Point3d, B: Point3d, C: Point3d
# ---------- c_pl_3pt: C# ----------
    //Component written by @krichterlunn

    //This component constructs a plane from three points
    Plane newpl = new Plane(A, B, C);

    //output new plane
    Pl = newpl;
# ---------- end c_pl_3pt ----------
panel_37 = Panel(c_pl_3pt.Pl)

# ---- group: Grasshopper Pl 3Pt
pl_3pt = Plane3Pt(PointA=pt_8, PointB=pt_9, PointC=pt_10)

# ----
panel_38 = Panel(pl_3pt)

pt_11 = Point(Point(0.01220753703, -1.47574791, 0))
c_pl_origin = CSharpScript(B=xy, O=pt_11)  # -> out, Pl; inputs B: Plane, O: Point3d
# ---------- c_pl_origin: C# ----------
    //Component written by @krichterlunn

    //set the new origin of plane B to be = O
    ​B.Origin = O;

    //output new plane
    Pl = B;
# ---------- end c_pl_origin ----------
panel_39 = Panel(c_pl_origin.Pl)

# ---- group: Grasshopper Pl Origin
pl_origin = PlaneOrigin(Base=xy, Origin=pt_11)

# ----
panel_40 = Panel(pl_origin)

crv_2 = Curve(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)
crv_3 = Curve(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)
c_lnln = CSharpScript(A=crv_2, B=crv_3)  # -> out, Pl; inputs A: Line, B: Line
# ---------- c_lnln: C# ----------
    // Component written by @krichterlunn

    // Vector x from start and end points of Line A
    Vector3d x = A.To - A.From;
    x.Unitize();

    // Vector y from start and end points of Line B
    Vector3d direction = B.To - B.From;
    Vector3d z = Vector3d.CrossProduct(x, direction);
    z.Unitize();
    Vector3d y = Vector3d.CrossProduct(z, x);

    // Construct new plane (origin = A.From, Vector x, Vector Y)
    Plane newpl = new Plane(A.From, x, y);

    // Output
    Pl = newpl;
# ---------- end c_lnln ----------
panel_41 = Panel(c_lnln.Pl)

# ---- group: Grasshopper LnLn
lnln = LineLine(LineA=crv_2, LineB=crv_3)

# ----
panel_42 = Panel(lnln)

Z_2 = UnitZ(Factor=1)
pt_12 = Point(Point(0.01220753703, -1.47574791, 0))
c_pl_2 = CSharpScript(O=pt_12, Z=Z_2)  # -> out, P; inputs O: Point3d, Z: Vector3d
# ---------- c_pl_2: C# ----------
    // Component written by @krichterlunn

    // Construct plane from a point3d = origin and a Vector3d = z
    Plane newpl = new Plane(O, Z);

    // Output
    P = newpl;
# ---------- end c_pl_2 ----------
panel_43 = Panel(c_pl_2.P)

# ---- group: Grasshopper Pl
pl_2 = PlaneNormal(Origin=pt_12, ZAxis=Z_2)

# ----
panel_44 = Panel(pl_2)

toggle = BooleanToggle(False)
toggle_2 = BooleanToggle(True)
toggle_3 = BooleanToggle(True)
c_pflip = CSharpScript(P=pln_2, X=toggle, Y=toggle_2, S=toggle_3)  # -> out, Pl; inputs P: Plane, X: Boolean, Y: Boolean, S: Boolean
# ---------- c_pflip: C# ----------
    //Component written by @krichterlunn

    //if boolean S = true then flip both x and y axis 
    if (S == true){
      P.Flip();
    }

    //if boolean X = true then flip XAxis 
    else if (X == true){
      P.XAxis = -P.XAxis;
    }

    //if boolean Y = true then flip YAxis
    else if (Y == true){
      P.YAxis = -P.YAxis;
    }

    //define ZAxis for all conditions
    P.ZAxis = Vector3d.CrossProduct(P.XAxis, P.YAxis);

    //output new plane 
    Pl = P;
# ---------- end c_pflip ----------
panel_45 = Panel(c_pflip.Pl)

# ---- group: Grasshopper PFlip
pflip = FlipPlane(Plane=pln_2, ReverseX=toggle, ReverseY=toggle_2, SwapAxes=toggle_3)

# ----
panel_46 = Panel(pflip)

xy_8 = XYPlane(Origin=Point(0, 0, 0))
Y_3 = UnitY(Factor=1)
c_align_2 = CSharpScript(P=pln_3, D=Y_3)  # -> out, Pl, A; inputs P: Plane, D: Vector3d
# ---------- c_align_2: C# ----------
    //Component written by @krichterlunn

    //minimanly rotate plane to align with vector D
    P.Rotate(Vector3d.VectorAngle(P.XAxis, D, P), P.ZAxis);

    double angle = Vector3d.VectorAngle(P.XAxis, D, P);

    //output new plane an angle of rotation
    Pl = P;
    A = angle; // this is still a problem
# ---------- end c_align_2 ----------
panel_47 = Panel(c_align_2.Pl)
panel_48 = Panel(c_align_2.A)

# ---- group: Grasshopper Align
align_2 = AlignPlane(Plane=pln_3, Direction=Y_3)  # -> Plane, Angle

# ----
panel_49 = Panel(align_2.Angle)
panel_50 = Panel(align_2.Plane)

xy_9 = XYPlane(Origin=Point(0, 0, 0))
pt_13 = Point(Point(12.08494025, 17.98450827, 0))
c_plcoord = CSharpScript(P=pt_13, S=xy_9)  # -> out, X, Y, Z; inputs P: Point3d, S: Plane
# ---------- c_plcoord: C# ----------
    //Component written by @krichterlunn

    // get the coordinates of a point3d in plane S
    X = P.X;
    Y = P.Y;
    Z = P.Z;
# ---------- end c_plcoord ----------
panel_51 = Panel(c_plcoord.Y)
panel_52 = Panel(c_plcoord.Z)
panel_53 = Panel(c_plcoord.X)

# ---- group: Grasshopper PlCoord
plcoord = PlaneCoordinates(Point=pt_13, System=xy_9)  # -> XCoordinate, YCoordinate, ZCoordinate

# ----
panel_54 = Panel(plcoord.YCoordinate)
panel_55 = Panel(plcoord.ZCoordinate)
panel_56 = Panel(plcoord.XCoordinate)
