# Grasshopper definition Curve_Analysis.ghx (Grasshopper 1.0.7)

pt = Point(Point(-2.47056265, 4.097518542, 0))
crv = Curve(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)
gh_crv_cp = CSharpScript(P=pt, C=crv)  # -> out, Pt, t, D; inputs P: Point3d, C: Curve
# ---------- gh_crv_cp: C# ----------
    // Component written by @joonhaeng-code
    // joonhaenglee@gsd.harvard.edu

    // Now we will get a closest point on input curve from input point.
    // To do that I found one function that find curve parameter t of the closest point.
    // Curve.Closest Point( input Point, Out t)
    // To extract the value t, we need to define that value first. lets say that as tempt (temporary t value).

    double tempt;

    // And run the function to get tempt

    C.ClosestPoint(P, out tempt);

    // Good! Now we have tempt value. It means, we can get the actual Point3d with xyz value in it.
    // Curve.PointAt(t) returns a point on input t value. Let's use this.

    Point3d pointOnCurve = C.PointAt(tempt);

    // Now you have a tempt and a point!
    // Lastly, lets get the distance between the input point and closest point!

    double distance = P.DistanceTo(pointOnCurve);

    // Done!
    // Now lets send tempt, pointOnCurve, and distance to c# output value.

    Pt = pointOnCurve;
    t = tempt;
    D = distance;
# ---------- end gh_crv_cp ----------
crv_cp = CurveClosestPoint(Point=pt, Curve=crv)  # -> Point, Parameter, Distance
panel = Panel(crv_cp.Point)
panel_2 = Panel(crv_cp.Parameter)
panel_3 = Panel(crv_cp.Distance)
panel_4 = Panel(gh_crv_cp.Pt)
panel_5 = Panel(gh_crv_cp.t)
panel_6 = Panel(gh_crv_cp.D)

geo = Geometry(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)
geo_2 = Geometry(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)
gh_crvprox = CSharpScript(A=geo, B=geo_2)  # -> out, PtA, PtB, D; inputs A: Curve, B: Curve
# ---------- gh_crvprox: C# ----------
    // Component written by @joonhaeng-code
    // joonhaenglee@gsd.harvard.edu

    // We will get a points in each curve which makes minial distance between two curves.
    // There is a method in Curve class to do this fucntion.
    // Curve.ClosestPoints( Curve, out Point1, out Point2)
    // to use this function, we need to define Point1 and Point2 first.

    // Let's make empty two Point3ds.

    Point3d Pt1;
    Point3d Pt2;

    // Let's use the method to get two points!

    A.ClosestPoints(B, out Pt1, out Pt2);

    // Now we have two Points. Pt1 is a point on A curve, and Pt2 is a curve on B.

    // Lastly, lets send this data to our C# component output.

    PtA = Pt1;
    PtB = Pt2;

    // One more, Let's get distance between those two points!

    D = Pt1.DistanceTo(Pt2);
# ---------- end gh_crvprox ----------
crvprox = CurveProximity(CurveA=geo, CurveB=geo_2)  # -> PointA, PointB, Distance
panel_7 = Panel(crvprox.PointA)
panel_8 = Panel(crvprox.PointB)
panel_9 = Panel(crvprox.Distance)
panel_10 = Panel(gh_crvprox.PtA)
panel_11 = Panel(gh_crvprox.PtB)
panel_12 = Panel(gh_crvprox.D)

crv_2 = Curve(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)
midpt = CurveMiddle(Curve=crv_2)
gh_midpt = CSharpScript(C=crv_2)  # -> out, M; inputs C: Curve
# ---------- gh_midpt: C# ----------
    // Component written by @joonhaeng-code
    // joonhaenglee@gsd.harvard.edu

    // Now we will get a middle point of input curve.
    // What is middle by the way? It could be the point that divide curve into two curves with same length.
    //
    // From Rhinocommon documentation, there is a function(below) that get Point that get a point at certain length from the startpoint.
    // Curve.PointAtLengt(Length)

    // So, If I know the "half length" of the curve, we might get the point in the middle.
    // To get "half length" lets try to get full length of the curve by using syntax
    // Curve.GetLength();

    double leng = C.GetLength();

    // Since we have leng, which is length of the curve, we can use
    // Curve.PointAtLengt(half length)

    M = C.PointAtLength(leng / 2);
# ---------- end gh_midpt ----------
panel_13 = Panel(midpt)
panel_14 = Panel(gh_midpt.M)

rec = Geometry(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)
drec = DeconstuctRectangle(Rectangle=rec)  # -> BasePlane, XInterval, YInterval
gh_drec = CSharpScript(R=rec)  # -> out, B, X, Y; inputs R: Rectangle3d
# ---------- gh_drec: C# ----------
    // Component written by @joonhaeng-code
    // joonhaenglee@gsd.harvard.edu

    // We will going to get Base Plane, width(X) and height(Y) of Rectangle.
    // Luckly, those are all properties of Rectangle.
    // So we can get those values directly buy using below.

    B = R.Plane;
    X = R.X;
    Y = R.Y;
# ---------- end gh_drec ----------
panel_15 = Panel(drec.YInterval)
panel_16 = Panel(gh_drec.B)
panel_17 = Panel(drec.BasePlane)
panel_18 = Panel(drec.XInterval)
panel_19 = Panel(gh_drec.X)
panel_20 = Panel(gh_drec.Y)

crv_3 = Curve(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)
gh_cls = CSharpScript(C=crv_3)  # -> out, Cl, P; inputs C: Curve
# ---------- gh_cls: C# ----------
    // Component written by @joonhaeng-code
    // joonhaenglee@gsd.harvard.edu

    // We will check whether the input curve is closed and is periodic.
    // Those are the properties of the curve.
    // We can get those value by using function below.

    Cl = C.IsClosed;
    P = C.IsPeriodic;
# ---------- end gh_cls ----------
cls = Closed(Curve=crv_3)  # -> Closed, Periodic
panel_21 = Panel(cls.Closed)
panel_22 = Panel(cls.Periodic)
panel_23 = Panel(gh_cls.Cl)
panel_24 = Panel(gh_cls.P)

# ----
# Curve Analysis
crv_4 = Curve(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)
# GH#: A C# dictionary of Grasshopper3D components.
# 
# This file contains a category of Grasshopper components, and a mirroring C#/RhinoCommon implementation.
# 
# This is an educational project initiated by students/faculty of GSD-6338: Introduction to Computational Design, at the Harvard Graduate School of Design.
# 
# More information: {{project link}}
cp = ControlPoints(Curve=crv_4)  # -> Points, Weights, Knots
gh_cp = CSharpScript(C=crv_4)  # -> out, P, W, K; inputs C: Curve
# ---------- gh_cp: C# ----------
    // Component written by @joonhaeng-code
    // joonhaenglee@gsd.harvard.edu

    // We will going to get Control Points, Weight, and Knots from curve.
    // Oh, in Rhinocommon, we can get those values from NurbsCurve Class since those are the properties of NurbsCurve.
    // Let change our Curve input to NurbsCurve.

    NurbsCurve tempC = C.ToNurbsCurve();

    // There will be more than one items or values in Point, Weight, and Knot. So I will going to make empty lists.

    List <Point3d> controlPoint = new List<Point3d>();
    List <double> Weights = new List<double>();
    List <double> Knots = new List<double>();

    // Lets get Control Points and Weights.
    // Control Point is a property of Nurbscurve, and Weight is a property of Control Point. So, we can use
    // Nurbscurve.Points
    // Nurbscurve.Points.GetWeight
    //
    // Let's get those value using for loop.
    // I will define a n value as the number of control points in Nurbscurve.

    int n = tempC.Points.Count;

    for (int i = 0 ; i < n ; i++)
    {

      // It does not mean that Control Point is same as point.
      // To get XYZ coordinate of control point, we have do extract XYZ value from control points and make a new points.

      Point3d tempControlPoint = new Point3d(tempC.Points[i].X, tempC.Points[i].Y, tempC.Points[i].Z);

      // Now tempControlPoint is a temporary new point on the [i]th controlpoint on Nurbscurve. Let's Put this point in our list.

      controlPoint.Add(tempControlPoint);

      // To get weight of control point, we can use
      // NurbsCurve.Points.GetWeight();

      double tempW = tempC.Points.GetWeight(i);

      // Let's add this weight value in our list.
      Weights.Add(tempW);

    }

    // Let's get Knots value using for loop.
    // I will define a np value as the number of knots in Nurbscurve.

    int np = tempC.Knots.Count;

    for (int i = 0 ; i < np ; i++)
    {
      Knots.Add(tempC.Knots[i]);
    }

    // Done!
    // Lastly, lets sent this list to our output values of this C# component.


    P = controlPoint;
    W = Weights;
    K = Knots;
# ---------- end gh_cp ----------
panel_25 = Panel(cp.Points)
panel_26 = Panel(cp.Weights)
panel_27 = Panel(cp.Knots)
panel_28 = Panel(gh_cp.P)
panel_29 = Panel(gh_cp.W)
panel_30 = Panel(gh_cp.K)

polygon = Geometry(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)
pcen = PolygonCenter(Polyline=polygon)  # -> CenterV, CenterE, CenterA
gh_pcen = CSharpScript(P=polygon)  # -> out, Cv, Ce, Ca; inputs P: Polyline
# ---------- gh_pcen: C# ----------
    // Component written by @joonhaeng-code, @garciadelcastillo
    // This grasshopper component gets 3 types of center points from Polyline

    // First, let's define temporary 0 values to contain sum of each vertex valuses.
    double tempX = 0;
    double tempY = 0;
    double tempZ = 0;
    int n = P.Count - 1;  // do not count the last vertex (duplicate on polylines)

    // For loop to add vertex values
    for (int i = 0 ; i < n; i++)
    {
      tempX = tempX + P.X[i];
      tempY = tempY + P.Y[i];
      tempZ = tempZ + P.Z[i];
    }

    // get average value and create a point.
    Point3d centerVertex = new Point3d(tempX / n, tempY / n, tempZ / n);

    // To get center area center point, lets make suface first and get mass centroid
    Brep[] brep = Brep.CreatePlanarBreps(P.ToNurbsCurve(), 0.001);
    if (brep != null && brep.Length > 0) {
      AreaMassProperties props = AreaMassProperties.Compute(brep[0]);
      Ca = props.Centroid;
    }

    Cv = centerVertex;

    // Center of edge point
    Ce = P.CenterPoint();
# ---------- end gh_pcen ----------
panel_31 = Panel(pcen.CenterV)
panel_32 = Panel(gh_pcen.Cv)
panel_33 = Panel(pcen.CenterE)
panel_34 = Panel(gh_pcen.Ce)
panel_35 = Panel(pcen.CenterA)
panel_36 = Panel(gh_pcen.Ca)

geo_3 = Geometry(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)
gh_disc = CSharpScript(C=geo_3, L="3")  # -> out, P, t; inputs C: Curve, L: Int32
# ---------- gh_disc: C# ----------
    // Component written by @joonhaeng-code
    // This grasshopper component checks contiuity of the curve.

    // There are 3 types of input L, 1 ,2,and 3. Those are choosing which curve continuous options to search.
    // In Rhinocommon, it is possible to search 'Next non-Continuity parameter' on curve rather than the number of total non continuity points.
    // So let's make empty list to put non continuity points, and count the number of each list.

    double temp;
    List<double> discont = new List<double>();
    List<Point3d> pts = new List<Point3d>();

    double a = C.Domain[0];
    double b = C.Domain[1];

    discont.Add(C.Domain[0]);
    pts.Add(C.PointAt(C.Domain[0]));

    // Check C1 continuity
    if( L == 1){
      while( C.GetNextDiscontinuity(Rhino.Geometry.Continuity.C1_continuous, a, b, out temp) ) {
        discont.Add(temp);
        pts.Add(C.PointAt(temp));
        a = temp;
      }
    }
      // Check C2 continuity
    else if(L == 2){
      while( C.GetNextDiscontinuity(Rhino.Geometry.Continuity.C2_continuous, a, b, out temp) ) {
        discont.Add(temp);
        pts.Add(C.PointAt(temp));
        a = temp;
      }
    }
      // Check Cinfinity continuity
    else if(L == 3){
      while( C.GetNextDiscontinuity(Rhino.Geometry.Continuity.Cinfinity_continuous, a, b, out temp) ) {
        discont.Add(temp);
        pts.Add(C.PointAt(temp));
        a = temp;
      }
    }


    discont.Add(C.Domain[1]);
    pts.Add(C.PointAt(C.Domain[1]));

    // Get discontinuity points and t parameters
    P = pts;
    t = discont;
# ---------- end gh_disc ----------
disc = Discontinuity(Curve=geo_3, Level="3")  # -> Points, Parameters
panel_37 = Panel(disc.Points)
panel_38 = Panel(gh_disc.P)
panel_39 = Panel(disc.Parameters)
panel_40 = Panel(gh_disc.t)

non_planar_curve = Geometry(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)
curvepoint = PointOnCurve(non_planar_curve, parameter=0.5)
crv_cp_2 = CurveClosestPoint(Point=curvepoint, Curve=non_planar_curve)  # -> Point, Parameter, Distance
gh_cruvature = CSharpScript(C=non_planar_curve, t=crv_cp_2.Parameter)  # -> out, P, K, Cir; inputs C: Curve, t: Double
# ---------- gh_cruvature: C# ----------
    // Component written by @joonhaeng-code
    // This grasshopper component get a point, curvature and curvature circle on curve parameter t
    
    // TODO: Match result with original
    Component.AddRuntimeMessage(GH_RuntimeMessageLevel.Warning, "Output doesn't match original exactly");

    // get point and curvature at parameter t on curve C
    Point3d pointOnCurve = C.PointAt(t);
    Vector3d curvature = C.CurvatureAt(t);

    // Curvature = 1/r, r = 1/curvature
    double radius = 1.0 / curvature.Length;
    curvature.Unitize();

    // Get center point of curvature circle
    Point3d tempPoint = pointOnCurve + curvature * radius * 2;
    Circle curvatureCircle = new Circle(pointOnCurve, C.TangentAt(t), tempPoint);

    // Outputs
    P = pointOnCurve;
    K = curvature;
    Cir = curvatureCircle;
# ---------- end gh_cruvature ----------
curvature = Curvature(Curve=non_planar_curve, Parameter=crv_cp_2.Parameter)  # -> P, K, C
panel_41 = Panel(curvature.P)
panel_42 = Panel(curvature.K)
panel_43 = Panel(curvature.C)
panel_44 = Panel(gh_cruvature.P)
panel_45 = Panel(gh_cruvature.K)
panel_46 = Panel(gh_cruvature.Cir)

non_planar_curve_2 = Geometry(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)
curvepoint_2 = PointOnCurve(non_planar_curve_2, parameter=0.5)
crv_cp_3 = CurveClosestPoint(Point=curvepoint_2, Curve=non_planar_curve_2)  # -> Point, Parameter, Distance
gh_cdiv = CSharpScript(C=non_planar_curve_2, t=crv_cp_3.Parameter)  # -> out, P, V; inputs C: Curve, t: Double
# ---------- gh_cdiv: C# ----------
    // Component written by @joonhaeng-code
    // This grasshopper component get a point and tangent vector on curve parameter t
    
    // TODO: Match result with original
    Component.AddRuntimeMessage(GH_RuntimeMessageLevel.Warning, "Output doesn't match original exactly");

    P = C.PointAt(t);
    V = C.TangentAt(t);
# ---------- end gh_cdiv ----------
cdiv = Derivatives(Curve=non_planar_curve_2, Parameter=crv_cp_3.Parameter)  # -> Point, FirstDerivative
panel_47 = Panel(cdiv.Point)
panel_48 = Panel(cdiv.FirstDerivative)
panel_49 = Panel(gh_cdiv.P)
panel_50 = Panel(gh_cdiv.V)

non_planar_curve_3 = Geometry(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)
curvepoint_3 = PointOnCurve(non_planar_curve_3, parameter=0.5)
crv_cp_4 = CurveClosestPoint(Point=curvepoint_3, Curve=non_planar_curve_3)  # -> Point, Parameter, Distance
gh_hframe = CSharpScript(C=non_planar_curve_3, t=crv_cp_4.Parameter)  # -> out, F; inputs C: Curve, t: Double
# ---------- gh_hframe: C# ----------
    // Component written by @joonhaeng-code
    // This grasshopper component get a hrozontal plane on curve parameter t.

    // horontal plane' Z Axis will be (0,0,1)
    // Let's remove Z Axis from C tangent vector

    Vector3d temp = new Vector3d(C.TangentAt(t).X, C.TangentAt(t).Y, 0);

    // Since we forced to remove ZAxis value, the size of vector will not be a 1. Make it unit vector
    temp.Unitize();

    // Set PlnX as temp
    Vector3d PlnX = temp;

    // Rotate 90 degreee or 0.25 T and make it as plnY
    temp.Rotate(Math.PI * 0.5, Vector3d.ZAxis);
    Vector3d PlnY = temp;

    // Construct Plane
    Plane horizontalPlane = new Plane(C.PointAt(t), PlnX, PlnY);

    F = horizontalPlane;
# ---------- end gh_hframe ----------
hframe = HorizontalFrame(Curve=non_planar_curve_3, Parameter=crv_cp_4.Parameter)
panel_51 = Panel(hframe)
panel_52 = Panel(gh_hframe.F)

non_planar_curve_4 = Geometry(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)
curvepoint_4 = PointOnCurve(non_planar_curve_4, parameter=0.5)
gh_curvepoint = CSharpScript(C=non_planar_curve_4, l="0.500")  # -> out, P; inputs C: Curve, l: Double
# ---------- gh_curvepoint: C# ----------
    // Component written by @joonhaeng-code
    // This grasshopper component get a point and middle( length) of the curve
    
    P = C.PointAtLength(C.GetLength() * l);
# ---------- end gh_curvepoint ----------
panel_53 = Panel(gh_curvepoint.P)
panel_54 = Panel(curvepoint_4)

geo_4 = Geometry(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)
gh_crvdom = CSharpScript(C=geo_4, D="0 To 2")  # -> out, Cr, Dm; inputs C: Curve
# ---------- gh_crvdom: C# ----------
    // Component written by @joonhaeng-code, @garciadelcastillo
    // This grasshopper component get a domain of curve.

    // First, let's export current input curve's domain.
    Dm = C.Domain;

    // Let's define curve's new domain with input interval D
    C.Domain = D;

    // Let's place our updated Curve into cr as an output.
    Cr = C;
# ---------- end gh_crvdom ----------
crvdom = CurveDomain(Curve=geo_4, Domain="0 To 2")  # -> Curve, Domain
panel_55 = Panel(crvdom.Curve)
panel_56 = Panel(crvdom.Domain)
panel_57 = Panel(gh_crvdom.Cr)
panel_58 = Panel(gh_crvdom.Dm)
crvdom_2 = CurveDomain(Curve=crvdom.Curve)  # -> Curve, Domain
crvdom_3 = CurveDomain(Curve=gh_crvdom.Cr)  # -> Curve, Domain
panel_59 = Panel(crvdom_2.Domain)
panel_60 = Panel(crvdom_3.Domain)

number_slider = Slider(0.5, range=0..1)
geo_5 = Geometry(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)
gh_lenp = CSharpScript(C=geo_5, P=number_slider)  # -> out, L1, L2; inputs C: Curve, P: Double
# ---------- gh_lenp: C# ----------
   
    // Component written by @joonhaeng-code
    // This grasshopper component get a split curves' length.
    
    // Get first half length of curve
    L1 = C.Split(P)[0].GetLength();
    
    // Get second half length of curve
    L2 = C.Split(P)[1].GetLength();
# ---------- end gh_lenp ----------
lenp = LengthParameter(Curve=geo_5, Parameter=number_slider)  # -> Length, Length_2
panel_61 = Panel(lenp.Length)
panel_62 = Panel(lenp.Length_2)
panel_63 = Panel(gh_lenp.L1)
panel_64 = Panel(gh_lenp.L2)

geo_6 = Geometry(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)
gh_len = CSharpScript(C=geo_6)  # -> out, L; inputs C: Curve
# ---------- gh_len: C# ----------
   
    // Component written by @joonhaeng-code
    // This grasshopper component get a length of curve.
    L = C.GetLength();
# ---------- end gh_len ----------
len = Length(Curve=geo_6)
panel_65 = Panel(len)
panel_66 = Panel(gh_len.L)

planar = Planar()  # -> Planar, Plane, Deviation
incurve = PointInCurve()  # -> Relationship, Point

crv_5 = Geometry(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)
darc = DeconstructArc(Arc=crv_5)  # -> BasePlane, Radius, Angle
gh_darc = CSharpScript(A=crv_5)  # -> out, B, R, An
# ---------- gh_darc: C# ----------
    // Component written by @joonhaeng-code
    // joonhaenglee@gsd.harvard.edu

    // We will get Plane, Radius and Angle Domain of input arc.
    // Those are the properties of the arc.
    // We can get those value by using function below.

    B = A.Plane;
    R = A.Radius;
    An = A.AngleDomain;
# ---------- end gh_darc ----------
panel_67 = Panel(darc.BasePlane)
panel_68 = Panel(darc.Radius)
panel_69 = Panel(darc.Angle)
panel_70 = Panel(gh_darc.B)
panel_71 = Panel(gh_darc.R)
panel_72 = Panel(gh_darc.An)

crv_6 = Curve(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)
cpoly = ControlPolygon(Curve=crv_6)  # -> Polygon, Points
gh_cpoly = CSharpScript(C=crv_6)  # -> out, CP, P; inputs C: Curve
# ---------- gh_cpoly: C# ----------
    // Component written by @joonhaeng-code
    // joonhaenglee@gsd.harvard.edu

    // We will get Control Points of input curve and polyline that links those points.
    // So, first, let's make a empty list to contain the control points.

    List<Point3d> Points = new List<Point3d>();

    for (int i = 0, n = C.ToNurbsCurve().Points.Count; i < n; i++)
    {
      // It does not mean that Control Point is same as point.
      // To get XYZ coordinate of control point, we have do extract XYZ value from control points and make a new points.
      // Meanwhile, to get Control Points from Curve, we have to convert Curve to Nurbscurve.
      // To do that, we can use
      // Curve.ToNurbsCurve()

      // So, X coordiate of ith Control Point of Curve may looks like following.
      // C.ToNurbsCurve().Points[i].X

      Point3d temp = new Point3d(C.ToNurbsCurve().Points[i].X, C.ToNurbsCurve().Points[i].Y, C.ToNurbsCurve().Points[i].Z);

      //Let's add this temp to our point list.
      Points.Add(temp);
    }

    // We can simply make polyline using Point list by using below.
    Polyline pl = new Polyline(Points);

    // Finally, let's make pl and Points as output of this C# components.
    CP = pl;
    P = Points;
# ---------- end gh_cpoly ----------
panel_73 = Panel(cpoly.Polygon)
panel_74 = Panel(cpoly.Points)
panel_75 = Panel(gh_cpoly.CP)
panel_76 = Panel(gh_cpoly.P)

crv_7 = Curve(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)
end = EndPoints(Curve=crv_7)  # -> Start, End
gh_end = CSharpScript(C=crv_7)  # -> out, S, E; inputs C: Curve
# ---------- gh_end: C# ----------
    // Component written by @joonhaeng-code
    // joonhaenglee@gsd.harvard.edu

    // Now we will get start Point and end point of input curve.
    // From Properties tap in Curve Class we can find that those two values are inherent properties of the curve.
    // So we can get those value easily by using function below.

    S = C.PointAtStart;
    E = C.PointAtEnd;
# ---------- end gh_end ----------
panel_77 = Panel(end.End)
panel_78 = Panel(end.Start)
panel_79 = Panel(gh_end.S)
panel_80 = Panel(gh_end.E)

geo_7 = Geometry(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)
number_slider_2 = Slider(2, range=0..100)
gh_crvgraph = CSharpScript(C=geo_7, D=number_slider_2, S=Slider(180, range=0..1000))  # -> out, P, L, Crv; inputs C: Curve, D: Int32, S: Double
# ---------- gh_crvgraph: C# ----------
    // Component written by @joonhaeng-code
    // This grasshopper component express curvature graph in form of curve

    // TODO: Match result with original
    Component.AddRuntimeMessage(GH_RuntimeMessageLevel.Warning, "Output doesn't match original exactly");

    // Let's make a list of points which will be a point to make a curvature curve.
    List<Point3d> pt = new List<Point3d>();

    // k will be the number of points which will represent curvature graph. you can modifiy it.
    // if k is too small, curvature graph would be too simplyfied.
    int k = 100;

    // using for loop, let's get curvature vectors
    for ( int i = 0, n = k + 1; i < n; i++){

      Point3d dividPt = C.PointAt(C.DivideByCount(k, true)[i]);
      Vector3d temp = C.CurvatureAt(C.DivideByCount(k, true)[i]);

      // move k points on curve in direction of curvature.
      double tempr = temp.Length;
      pt.Add(dividPt + temp * S * -1);

    }

    P = pt;
    Crv = Curve.CreateInterpolatedCurve(pt, 3);
# ---------- end gh_crvgraph ----------
crvgraph = CurvatureGraph(Curve=geo_7, Density=number_slider_2, Scale=Slider(115, range=0..1000))
panel_81 = Panel(gh_crvgraph.P)
panel_82 = Panel(gh_crvgraph.Crv)

number_slider_3 = Slider(83, range=0..100)
non_planar_curve_5 = Geometry(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)
gh_frame = CSharpScript(C=non_planar_curve_5, t=number_slider_3)  # -> out, F; inputs C: Curve, t: Double
# ---------- gh_frame: C# ----------
    // Component written by @joonhaeng-code
    // This grasshopper component get a frame plane of the curve

    Plane tempPl = new Plane(C.PointAt(t), C.TangentAt(t), C.CurvatureAt(t));
    F = tempPl;
# ---------- end gh_frame ----------
frame = CurveFrame(Curve=non_planar_curve_5, Parameter=number_slider_3)
panel_83 = Panel(gh_frame.F)
panel_84 = Panel(frame)

side = CurveSide()  # -> Side, Left, Right
crvnear = CurveNearestObject()  # -> PointA, PointB, Index
x_tremez = Extremes(Plane=PlaneXY(0, 0, 0))  # -> Highest, Lowest
lenseg = SegmentLengths()  # -> ShortestLength, ShortestDomain, LongestLength, LongestDomain
incurves = PointInCurves()  # -> Relationship, Index, Point
eval = EvaluateCurve()  # -> Point, Tangent, Angle
torsion = Torsion()  # -> Point, Torsion
eval_2 = EvaluateLength(Normalized=True)  # -> Point, Tangent, Parameter
lend = LengthDomain()
pframe = PerpFrame()
