# Grasshopper definition Curve_Primitive.ghx (Grasshopper 1.0.7)

pt = Point(Point(-122.2137732, 55.64449833, 0))
pt_2 = Point(Point(-114.2646856, 55.64449833, 0))
pt_3 = Point(Point(-108.5193055, 48.2463376, 0))
inellipse = InEllipse(CornerA=pt, CornerB=pt_2, CornerC=pt_3)  # -> Ellipse, Plane
c_inellipse = CSharpScript(A=pt, B=pt_2, C=pt_3)  # -> out, E, P; inputs A: Point3d, B: Point3d, C: Point3d
# ---------- c_inellipse: C# ----------
//Component written by @Suekim37
List<Point3d> pts = new List<Point3d>();
pts.Add(A);
pts.Add(B);
pts.Add(C);
pts.Add(A);

Polyline pl = new Polyline(pts);
PolylineCurve plc = pl.ToPolylineCurve();

plc.TryGetEllipse(out Ellipse el);
E = el;
P = el.Plane;
# ---------- end c_inellipse ----------
geo = Geometry(inellipse.Ellipse)
pln = Plane(inellipse.Plane)
panel = Panel(c_inellipse.P)
pln_2 = Plane(c_inellipse.P)
geo_2 = Geometry(c_inellipse.E)

circle = Circle({Plane=Plane(origin=(-484.3399034, 394.4224697, 19.79245562), x=(-0.5818591757, -0.8132895546, 0), y=(0.8132895546, -0.5818591757, 0)), Radius=180.0652852})
circle_2 = Circle({Plane=Plane(origin=(-210.4079864, 339.463561, -34.74934781), x=(0.7059537194, 0.7082579658, 0), y=(-0.7082579658, 0.7059537194, 0)), Radius=153.22132})
c_tanex = CSharpScript(A=circle_2, B=circle)  # -> out, T1, T2
# ---------- c_tanex: C# ----------
double x = 0.1;
double y = 0.1;

Line l1 = new Line();
Line l2 = new Line();
//NurbsCurve nc = new NurbsCurve();


NurbsCurve a = NurbsCurve.CreateFromCircle(A);

NurbsCurve b = NurbsCurve.CreateFromCircle(B);


Circle.TryFitCircleTT(a, b, x, y);

Line.TryCreateBetweenCurves(a, b, ref x, ref x, false, false, out l1);
Line.TryCreateBetweenCurves(a, b, ref y, ref y, false, false, out l2);

T1 = l1;
T2 = l2;
# ---------- end c_tanex ----------
c_tanex_2 = CSharpScript(A=circle_2, B=circle)  # -> out, T1, T2
# ---------- c_tanex_2: C# ----------
double x = 1.0;
double y = 3.0;

Line l = new Line();
Line l2 = new Line();
//NurbsCurve nc = new NurbsCurve();


NurbsCurve a = NurbsCurve.CreateFromCircle(A);

NurbsCurve b = NurbsCurve.CreateFromCircle(B);


Circle.TryFitCircleTT(a, b, x, y);

Line.TryCreateBetweenCurves(a, b, ref x, ref x, false, false, out l);
Line.TryCreateBetweenCurves(a, b, ref y, ref y, false, false, out l2);

T1 = l;
T2 = l2;
# ---------- end c_tanex_2 ----------
tanex = TangentLinesEx(CircleA=circle_2, CircleB=circle)  # -> Tangent1, Tangent2
line = Line(tanex.Tangent1)
line_2 = Line(c_tanex.T1)
line_3 = Line(c_tanex.T2)
line_4 = Line(tanex.Tangent2)

number_slider = Slider(0.5, range=0..1)
vec = Vector(Vector(-247.6323881, -237.0852887, 0))
vec_2 = Vector(Vector(-219.4105172, -303.8747764, 0))
pt_4 = Point(Point(-339.3951548, -374.7666514, 0))
pt_5 = Point(Point(-264.9899016, -462.9588144, 0))
biarc = BiArc(StartPoint=pt_4, StartTangent=vec, EndPoint=pt_5, EndTangent=vec_2, Ratio=number_slider)  # -> FirstArc, SecondArc, BiArc
c_biarc = CSharpScript(S=pt_4, Ts=vec, E=pt_5, Te=vec_2, R=number_slider)  # -> out, A1, A2, B, A, C; inputs S: Point3d, Ts: Vector3d, E: Point3d, Te: Vector3d, R: Double
# ---------- c_biarc: C# ----------
//Component written by @Suekim37
//Create an arc from three points
Vector3d v = new Vector3d(E.X-S.X, E.Y-S.Y, E.Z - S.Z);
Vector3d v_mid = new Vector3d(v * R);

Point3d mid = new Point3d(S.X + v_mid.X, S.Y + v_mid.Y, S.Z + v_mid.Z);
Arc arc1 = new Arc(S, Ts, mid);
Arc arc2 = new Arc(E, Te, mid);

//outputs
A1 = arc1;
A2 = arc2;
B = mid;
A = arc1.Radius;
C =v;
# ---------- end c_biarc ----------
geo_3 = Geometry(biarc.BiArc)
arc = CircularArc(biarc.FirstArc)
arc_2 = CircularArc(biarc.SecondArc)
arc_3 = CircularArc(c_biarc.A1)
arc_4 = CircularArc(c_biarc.A2)
geo_4 = Geometry(c_biarc.B)
len = Length(Curve=arc_2)
len_2 = Length(Curve=arc)

circle_3 = Circle({Plane=Plane(origin=(-224.9648359, -170.4030675, 0), x=(-0.1590597109, -0.9872689645, 0), y=(0.9872689645, -0.1590597109, 0)), Radius=15.12524551})
circle_4 = Circle({Plane=Plane(origin=(-237.4107737, -115.0053346, 0), x=(-0.1828460778, -0.9831415523, 0), y=(0.9831415523, -0.1828460778, 0)), Radius=24.42570758})
c_tanin = CSharpScript(A=circle_4, B=circle_3)  # -> out, T1, T2
# ---------- c_tanin: C# ----------
double x = 1.0;
double y = 3.0;

NurbsCurve a = NurbsCurve.CreateFromCircle(A);
NurbsCurve b = NurbsCurve.CreateFromCircle(B);


Line.TryCreateBetweenCurves(a, b, ref x, ref y, true, true, out Line l);
Line.TryCreateBetweenCurves(a, b, ref y, ref x, false, false, out Line l2);

T1 = l;
T2 = l2;
# ---------- end c_tanin ----------
tanin = TangentLinesIn(CircleA=circle_4, CircleB=circle_3)  # -> Tangent1, Tangent2
line_5 = Line(c_tanin.T2)
line_6 = Line(c_tanin.T1)
line_7 = Line(tanin.Tangent1)
line_8 = Line(tanin.Tangent2)

number_slider_2 = Slider(9.7, range=0..10)
number_slider_3 = Slider(3, range=0..10)
pln_3 = Plane(Plane(origin=(-205.3293543, -264.8921459, 0), x=(0.8033042613, 0.5955688574, 0), y=(0.1239811881, -0.1672260319, -0.9780920812)))
c_arc = CSharpScript(P=pln_3, R=number_slider_2, A=number_slider_3)  # -> out, Arc, L; inputs P: Plane, R: Double, A: Double
# ---------- c_arc: C# ----------
//Component written by @Suekim37
//Create an arc from plane, radius and angle
Arc arc = new Arc(P, R, A);

Arc = arc;
L = arc.Length;
# ---------- end c_arc ----------
panel_2 = Panel(c_arc.L)
arc_5 = CircularArc(c_arc.Arc)

# ---- group: Grasshopper Arc
arc_6 = Arc(Plane=pln_3, Radius=number_slider_2, Angle=number_slider_3)  # -> Arc, Length

# ----
panel_3 = Panel(arc_6.Length)
arc_7 = CircularArc(arc_6.Arc)

vec_3 = Vector(Vector(-209.7498489, -298.3924404, 0))
pt_6 = Point(Point(-264.9899016, -285.6511768, 0))
pt_7 = Point(Point(-261.7124038, -250.896599, 0))
c_arc_2 = CSharpScript(S=pt_7, E=pt_6, D=vec_3)  # -> out, Arc, P, R; inputs S: Point3d, E: Point3d, D: Vector3d
# ---------- c_arc_2: C# ----------
//Component written by @Suekim37
//Create an arc from start point, end point, and the direction
Arc arc = new Arc(S, D, E);

Arc = arc;
P = arc.Plane;
R = arc.Radius;
# ---------- end c_arc_2 ----------
arc_8 = CircularArc(c_arc_2.Arc)
panel_4 = Panel(c_arc_2.R)
pln_4 = Plane(c_arc_2.P)

# ---- group: Grasshopper Arc
arc_9 = ArcSED(Start=pt_7, End=pt_6, Direction=vec_3)  # -> Arc, Plane, Radius

# ----
arc_10 = CircularArc(arc_9.Arc)
pln_5 = Plane(arc_9.Plane)
panel_5 = Panel(arc_9.Radius)

number_slider_4 = Slider(3.5, range=0..10)
number_slider_5 = Slider(5, range=0..10)
pln_6 = Plane(Plane(origin=(2.442382, -22.92411509, 0), x=(-0.0943512179, 0.9955389735, 0), y=(0.9955389735, 0.0943512179, 0)))
c_ellipse = CSharpScript(P=pln_6, R1=number_slider_4, R2=number_slider_5)  # -> out, E, F1, F2; inputs P: Plane, R1: Double, R2: Double
# ---------- c_ellipse: C# ----------
//Component written by @Suekim37
//R1 is an ellipse radius along base plane X direction.
//R2 is an ellipse radius along base plane Y direction. @Rhinocommon

//Focus of Ellipse
//An ellipse is defined by two points, each called a focus. (F1, F2 here).
//If you take any point on the ellipse, the sum of the distances to the focus points is constant.
//source: https://www.mathopenref.com/ellipse.html

//Create an epllipse
Ellipse e = new Ellipse(P, R1, R2);

//Get the distance between the foci and the center
double F = Math.Sqrt(Math.Abs((R1 * R1) - (R2 * R2)));

//Get the foci point from the center point of ellipse
Point3d foci1 = new Point3d(P.Origin + P.YAxis * F);
Point3d foci2 = new Point3d(P.Origin - P.YAxis * F);

//output
E = e; // geometry
F1 = foci1; 
F2 = foci2;
# ---------- end c_ellipse ----------
panel_6 = Panel(c_ellipse.F1)
panel_7 = Panel(c_ellipse.F2)
pt_8 = Point(c_ellipse.F1)
pt_9 = Point(c_ellipse.F2)
geo_5 = Geometry(c_ellipse.E)

# ---- group: Grasshopper Ellipse
ellipse = Ellipse(Plane=pln_6, Radius1=number_slider_4, Radius2=number_slider_5)  # -> Ellipse, Focus1, Focus2

# ----
geo_6 = Geometry(ellipse.Ellipse)
panel_8 = Panel(ellipse.Focus2)
pt_10 = Point(ellipse.Focus1)
pt_11 = Point(ellipse.Focus2)
panel_9 = Panel(ellipse.Focus1)

number_slider_6 = Slider(8.6, range=0..10)
vec_4 = Vector(Vector(93.19585365, 32.9231477, 0))
pt_12 = Point(Point(-8.844056887, 75.87621468, 0))
c_circle = CSharpScript(C=pt_12, N=vec_4, R=number_slider_6)  # -> out, Cir; inputs C: Point3d, N: Vector3d, R: Double
# ---------- c_circle: C# ----------
//Component written by @Suekim37
//Create a plane with the center point and a normal vector
Plane plane = new Plane(C, N);

//Create a circle with the plane and radius
Circle circle = new Circle(plane, R);

//output
Cir = circle;
# ---------- end c_circle ----------
panel_10 = Panel(c_circle.Cir)
circle_5 = Circle(c_circle.Cir)

# ---- group: Grasshopper Circle
circle_6 = CircleCNR(Center=pt_12, Normal=vec_4, Radius=number_slider_6)

# ----
panel_11 = Panel(circle_6)
circle_7 = Circle(circle_6)

number_slider_7 = Slider(8.6, range=0..10)
pln_7 = Plane(Plane(origin=(40.29354661, 70.88856589, 0), x=(-0.38110474, 0.9245318692, 0), y=(-0.9245318692, -0.38110474, 0)))
c_cir = CSharpScript(P=pln_7, R=number_slider_7)  # -> out, C; inputs P: Plane, R: Double
# ---------- c_cir: C# ----------
//Component written by @Suekim37
//Create a circle with plane and radius
Circle circle = new Circle(P, R);

//output
C = circle;
# ---------- end c_cir ----------
panel_12 = Panel(c_cir.C)
circle_8 = Circle(c_cir.C)

# ---- group: Grasshopper Cir
cir = Circle(Plane=pln_7, Radius=number_slider_7)

# ----
panel_13 = Panel(cir)
circle_9 = Circle(cir)

number_slider_8 = Slider(10, range=0..10)
pt_13 = Point(<point referenced from the Rhino model>)
vec_5 = Vector(Vector(175.5572344, 356.437075, 0))
c_line = CSharpScript(S=pt_13, D=vec_5, L=number_slider_8)  # -> out, Line; inputs S: Point3d, D: Vector3d, L: Double
# ---------- c_line: C# ----------
//Component written by @Suekim37
//Create a line with starting point, direction vector, and line length
Line line = new Line(S, D, L);


//output
Line = line;
# ---------- end c_line ----------
line_9 = Line(c_line.Line)
panel_14 = Panel(c_line.Line)

# ---- group: Grasshopper Line
line_10 = LineSDL(Start=pt_13, Direction=vec_5, Length=number_slider_8)

# ----
line_11 = Line(line_10)
panel_15 = Panel(line_10)

crv = Curve(<curve referenced from the Rhino model>)
pt_14 = Point(Point(190.8761495, 268.8869751, 0))
crv_2 = Curve(<curve referenced from the Rhino model>)
c_circlett = CSharpScript(A=crv, B=crv_2, P=pt_14)  # -> out, C; inputs A: Curve, B: Curve, P: Point3d
# ---------- c_circlett: C# ----------
//Component written by @Suekim37
//x and y are the parameters on first and second curve close to desired solution respectively
double x = 0.1;
double y = 0.1;

//Try to fit a circle to two curves using tangent relationships @Rhinocommon
//output
C = Circle.TryFitCircleTT(A, B, x, y);
# ---------- end c_circlett ----------
panel_16 = Panel(c_circlett.C)
circle_10 = Circle(c_circlett.C)

# ---- group: Grasshopper CircleTT
circlett = CircleTanTan(CurveA=crv, CurveB=crv_2, Point=pt_14)

# ----
panel_17 = Panel(circlett)
circle_11 = Circle(circlett)

# ----
# GH#: A C# dictionary of Grasshopper3D components.
# 
# This file contains a category of Grasshopper components, and a mirroring C#/RhinoCommon implementation.
# 
# This is an educational project initiated by students/faculty of GSD-6338: Introduction to Computational Design, at the Harvard Graduate School of Design.
# 
# More information: {{project link}}
# Curve Primitive
pt_15 = Point([Point(155.8388528, 71.52896409, 0), Point(51.30531797, 108.1264096, 0), Point(73.84949321, 151.7913449, 0), Point(-21.15314735, 182.7391885, 0), Point(13.84048851, 76.2304555, 0), Point(93.00540162, 50.08050932, 0), Point(183.6595771, 31.76672344, 0), Point(135.6409858, 173.1669196, 0), Point(69.04437681, 82.55870659, 0), Point(187.854755, 76.16309522, 0), Point(-13.72068491, 121.8715823, 0)])
c_fline = CSharpScript(P=pt_15)  # -> out, L; inputs P: list of Point3d
# ---------- c_fline: C# ----------
//Component written by @Suekim37
//Define a new line
Line line = new Line();

//Fit the line to the input points
//Output of this command is stored in line
Line.TryFitLineToPoints(P, out line);

//output
L = line;
# ---------- end c_fline ----------
panel_18 = Panel(c_fline.L)
line_12 = Line(c_fline.L)

# ---- group: Grasshopper FLine
fline = FitLine(Points=pt_15)

# ----
panel_19 = Panel(fline)
line_13 = Line(fline)

line_14 = Line(Line((41.94704549, 5.825640335, 0), (39.941881, 4.279016464, 0)))
pln_8 = Plane(Plane(origin=(20.97150673, -0.136257349, 0), x=(0.9571080123, -0.2897313459, 0), y=(-0.1598520283, -0.528060423, 0.8340260899)))
pln_9 = Plane(Plane(origin=(24.35638041, 17.96202863, 0), x=(0.9887231656, -0.1497548055, 0), y=(-0.0997478762, -0.6585634135, 0.7458851061)))
c_ln2pl = CSharpScript(L=line_14, A=pln_9, B=pln_8)  # -> out, Line; inputs L: Line, A: Plane, B: Plane
# ---------- c_ln2pl: C# ----------
//Component written by @Suekim37
Rhino.Geometry.Intersect.Intersection.LinePlane(L, A, out double lineparam);

Line = lineparam;
# ---------- end c_ln2pl ----------
panel_20 = Panel(c_ln2pl.Line)
line_15 = Line(c_ln2pl.Line)

# ---- group: Grasshopper Ln2Pl
ln2pl = Line2Plane(Line=line_14, PlaneA=pln_9, PlaneB=pln_8)

# ----
panel_21 = Panel(ln2pl)
line_16 = Line(ln2pl)

pt_16 = Point(Point(-264.9899016, -285.6511768, 0))
pt_17 = Point(Point(-261.1869512, -313.4963266, 0))
pt_18 = Point(Point(-261.7124038, -250.896599, 0))
c_arc_3 = CSharpScript(A=pt_18, B=pt_16, C=pt_17)  # -> out, Arc, P, R; inputs A: Point3d, B: Point3d, C: Point3d
# ---------- c_arc_3: C# ----------
//Component written by @Suekim37
//Create an arc from three points
Arc arc = new Arc(A, B, C);

//outputs
Arc = arc;
P = arc.Plane;
R = arc.Radius;
# ---------- end c_arc_3 ----------
arc_11 = CircularArc(c_arc_3.Arc)
panel_22 = Panel(c_arc_3.R)
pln_10 = Plane(c_arc_3.P)

# ---- group: Grasshopper Arc
arc_12 = Arc3Pt(PointA=pt_18, PointB=pt_16, PointC=pt_17)  # -> Arc, Plane, Radius

# ----
arc_13 = CircularArc(arc_12.Arc)
panel_23 = Panel(arc_12.Radius)
pln_11 = Plane(arc_12.Plane)

crv_3 = Curve(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)
crv_4 = Curve(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)
crv_5 = Curve(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)
pt_19 = Point(Point(-3.080714717, 58.29432374, 0))

# ---- group: Grasshopper CircleTTT
circlettt = CircleTanTanTan(CurveA=crv_3, CurveB=crv_4, CurveC=crv_5, Point=pt_19)

# ---- group: C# CircleTTT
c_circlett_2 = CSharpScript(A=crv_3, B=crv_4, C=crv_5, P=pt_19)  # -> out, Cir; inputs A: Curve, B: Curve, C: Curve, P: Point3d
# ---------- c_circlett_2: C# ----------
//Component written by @Suekim37
//x and y are the parameters on first and second curve close to desired solution respectively
double x = 0.1;
double y = 0.1;
double z = 0.1;

//Try to fit a circle to two curves using tangent relationships @Rhinocommon
//output
Cir = Circle.TryFitCircleTTT(A, B, C, x, y, z);
# ---------- end c_circlett_2 ----------

# ----
panel_24 = Panel(circlettt)
circle_12 = Circle(circlettt)
panel_25 = Panel(c_circlett_2.Cir)
circle_13 = Circle(c_circlett_2.Cir)

pt_20 = Point(Point(-11.07504258, 0.9097356401, 0))
pt_21 = Point(Point(-7.437512648, -10.93983342, 0))
pt_22 = Point(Point(-3.40162022, 0.1186611705, 0))
c_incircle = CSharpScript(A=pt_20, B=pt_21, C=pt_22)  # -> out, Cir, P, R; inputs A: Point3d, B: Point3d, C: Point3d
# ---------- c_incircle: C# ----------
//Component written by @Suekim37

//Draw temporary lines from the points
Line a = new Line(A,B);
Line b = new Line(B,C);
Line c = new Line(C,A);

//Convert lines to curves to fit a circle in it
Curve c1 = a.ToNurbsCurve();
Curve c2 = b.ToNurbsCurve();
Curve c3 = c.ToNurbsCurve();

//Fit a circle in the triangle
Circle circle = Circle.TryFitCircleTTT(c1,c2,c3, 0.1, 0.1, 0.1);
//Create plane from the normal vector and the center point of circle.
Plane pl = new Plane(circle.Center, circle.Normal);

//Outputs
Cir = circle;
P = pl;
R = circle.Radius;
# ---------- end c_incircle ----------
circle_14 = Circle(c_incircle.Cir)
pln_12 = Plane(c_incircle.P)
panel_26 = Panel(c_incircle.R)

# ---- group: Grasshopper InCircle
incircle = InCircle(CornerA=pt_20, CornerB=pt_21, CornerC=pt_22)  # -> Circle, Plane, Radius

# ----
circle_15 = Circle(incircle.Circle)
pln_13 = Plane(incircle.Plane)
panel_27 = Panel(incircle.Radius)

# ---- group: get different circles sometimes
pt_23 = Point([Point(-121.1336366, 92.4062709, 0), Point(-116.1971314, 74.67141895, 0), Point(-127.0284732, 65.55135763, 0), Point(-92.37420679, 98.42848215, 0), Point(-94.69990153, 59.96386069, 0), Point(-107.6039557, 66.7654269, 0)])
c_fcircle = CSharpScript(P=pt_23)  # -> out, C, R, D; inputs P: list of Point3d
# ---------- c_fcircle: C# ----------
//Component written by @Suekim37

//Fit a circle to the given points list
//The output is stored in 'out Circle c'
Circle.TryFitCircleToPoints(P, out Circle c);

//Get the maximum distance between circle and points.
//For that, create a distance list at first.
List<double> dists = new List<double>();

//Get the closest points on the circle from each point on the list.
//Get the distance of each of pair, and store them to the list created above.
for (int i = 0; i < P.Count; i ++)
{
    Point3d p = c.ClosestPoint(P[i]);
    double dist = p.DistanceTo(P[i]);
    dists.Add(dist);
}

//sort the list by distance value (ascending) to get the maximum value
dists.Sort();

//Outputs
C = c;
R = c.Radius;
D = dists[P.Count-1]; // the last value of the distance list
# ---------- end c_fcircle ----------
circle_16 = Circle(c_fcircle.C)
panel_28 = Panel(c_fcircle.D)
panel_29 = Panel(c_fcircle.R)

# ---- group: get different circles sometimes / Grasshopper FCircle
fcircle = CircleFit(Points=pt_23)  # -> Circle, Radius, Deviation

# ---- group: get different circles sometimes (continued)
circle_17 = Circle(fcircle.Circle)
panel_30 = Panel(fcircle.Radius)
panel_31 = Panel(fcircle.Deviation)

# ----
pt_24 = Point(Point(59.84576683, -56.08766616, 0))
pt_25 = Point(Point(14.28961613, -57.39863453, 0))
pt_26 = Point(Point(110.645791, -17.08635728, 0))
c_circle_2 = CSharpScript(A=pt_24, B=pt_25, C=pt_26)  # -> out, Cir, P, R; inputs A: Point3d, B: Point3d, C: Point3d
# ---------- c_circle_2: C# ----------
//Component written by @Suekim37
//Define a circle with three points
Circle circle = new Circle(A, B, C);


//outputs
Cir = circle;
P = circle.Plane;
R = circle.Radius;
# ---------- end c_circle_2 ----------
circle_18 = Circle(c_circle_2.Cir)
pln_14 = Plane(c_circle_2.P)
panel_32 = Panel(c_circle_2.R)

# ---- group: Grasshopper Circle
circle_19 = Circle3Pt(PointA=pt_24, PointB=pt_25, PointC=pt_26)  # -> Circle, Plane, Radius

# ----
circle_20 = Circle(circle_19.Circle)
pln_15 = Plane(circle_19.Plane)
panel_33 = Panel(circle_19.Radius)

pt_27 = Point(Point(90.04353155, 431.0087378, 0))
pt_28 = Point(Point(51.64304902, 11.48408087, 0))
c_ln = CSharpScript(A=pt_28, B=pt_27)  # -> out, L; inputs A: Point3d, B: Point3d
# ---------- c_ln: C# ----------
//Component written by @Suekim37
//Create a line with two points 
Line line = new Line(A,B);

//output
L = line;
# ---------- end c_ln ----------
panel_34 = Panel(c_ln.L)
line_17 = Line(c_ln.L)

# ---- group: Grasshopper Ln
ln = Line(StartPoint=pt_28, EndPoint=pt_27)

# ----
panel_35 = Panel(ln)
line_18 = Line(ln)

pt_29 = Point(Point(93.00540162, 50.08050932, 0))
line_19 = Line(Line((36.37579819, 31.61502154, 0), (66.44652427, 29.5490938, 0)))
pt_30 = Point(Point(-67.62681419, 108.9522877, 0))
c_ln4pt = CSharpScript(L=line_19, A=pt_29, B=pt_30)  # -> out, Line; inputs L: Line, A: Point3d, B: Point3d
# ---------- c_ln4pt: C# ----------
//Component written by @Suekim37
//Define two points
Point3d a = new Point3d();
Point3d b = new Point3d();

//Get the points projected on the line
a = L.ClosestPoint(A, false); 
b = L.ClosestPoint(B, false);

//Make a line with projected points
Line line = new Line(a,b);

//output
Line = line;
# ---------- end c_ln4pt ----------
panel_36 = Panel(c_ln4pt.Line)
line_20 = Line(c_ln4pt.Line)

# ---- group: Grasshopper Ln4Pt
ln4pt = Line4Pt(Line=line_19, PointA=pt_29, PointB=pt_30)

# ----
line_21 = Line(ln4pt)
panel_37 = Panel(ln4pt)

circle_21 = Circle({Plane=Plane(origin=(17.84871099, -18.26387632, 0), x=(-0.6049502706, 0.7962632543, 0), y=(-0.7962632543, -0.6049502706, 0)), Radius=10.9756345})
pt_31 = Point(Point(31.60245599, -1.72550109, 0))
c_tan = CSharpScript(P=pt_31, C=circle_21)  # -> out, T1, T2; inputs P: Point3d
# ---------- c_tan: C# ----------
Point3d tan = new Point3d();
//0.5* Math.PI = Vector3d.VectorAngle(C.Center - tan, P - tan);
# ---------- end c_tan ----------
panel_38 = Panel(c_tan.T2)
line_22 = Line(c_tan.T1)
line_23 = Line(c_tan.T2)
panel_39 = Panel(c_tan.T1)

# ---- group: Grasshopper Tan
tan = TangentLines(Point=pt_31, Circle=circle_21)  # -> Tangent1, Tangent2

# ----
panel_40 = Panel(tan.Tangent2)
panel_41 = Panel(tan.Tangent1)
line_24 = Line(tan.Tangent1)
line_25 = Line(tan.Tangent2)
