# Grasshopper definition Curve_Util.ghx (Grasshopper 1.0.7)

# ---- group: Fillet Distance
number_slider = Slider(5, range=0..12)
crv = Curve([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])
gh_fillet = GHFilletDistance(C=crv, D=number_slider)  # -> out, c; inputs C: Curve, D: Double
# ---------- gh_fillet: C# ----------
    // Written by @v-xup6

    // Fillet the sharp corners of a curve by distance

    // Get each segment of the curve and segment count
    Curve[] segments = C.DuplicateSegments();
    int count = segments.Length;

    // If there's no segments, cannot fillet
    if(count == 0) return;

    // Check if there's any non-linear segment
    foreach(Curve seg in segments){
      // If there's a non-linear segment
      // don't fillet this curve at all
      if(!seg.IsLinear()){
        c = C;
        return;
      }
    }

    // Create list to store all fillets
    List<Curve> fillets = new List<Curve>();

    // Iterate thru segment pairs to see if fillet-able
    for(int i = 0;i < count;i++){
      // Get index of second line, if curve is periodic
      // last segment gets paired with first
      int i2 = i + 1;
      if(i2 == count){
        if(C.IsClosed) i2 = 0;
        else break;
      }

      // Get lengths of the pair
      double length = segments[i].GetLength();
      double length2 = segments[i2].GetLength();
      
      // Need to implement distance clamp
      // if fillet distance is larger than possible
      // reduce fillet distance to fit

      // Clamp fillet distance if too large for segment pair
      double fD = D;
      if(fD > length || fD > 0.5 * length2){
        if(length > 0.5 * length2) fD = 0.5 * length2;
        else fD = length;
      }

      // If fillet-able and there's enought length
      if(length > D && length2 > D){
        // Parameter of start and end of fillet
        double t0, t1;

        // Set new length for first segment
        // and find its parameter, point and tangent at the end
        length = length - D;
        segments[i].LengthParameter(length, out t0);
        Point3d start = segments[i].PointAt(t0);
        Vector3d tangent = segments[i].TangentAt(t0);
        // Shorten 1st segment to fit the fillet
        segments[i] = segments[i].Split(t0)[0];

        // Find parameter and point at new start of 2nd segment
        segments[i2].LengthParameter(D, out t1);
        Point3d end = segments[i2].PointAt(t1);
        // Shorten 2nd segment to fit the fillet
        segments[i2] = segments[i2].Split(t1)[1];

        // Create the fillet arc and store it as a curve
        Arc fillet = new Arc(start, tangent, end);
        fillets.Add(fillet.ToNurbsCurve());
      }
    }

    // Store segments together with fillets so they can be joined
    fillets.AddRange(segments);
    Curve[] crv = Curve.JoinCurves(fillets);

    // Output
    c = crv[0];
# ---------- end gh_fillet ----------
fillet = FilletDistance(Curve=crv, Distance=number_slider)
panel = Panel(fillet)
panel_2 = Panel(gh_fillet.c)

# ---- group: Fillet
number_slider_2 = Slider(10, range=0..10)
crv_2 = Curve(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)
fillet_2 = Fillet(Curve=crv_2, Radius=number_slider_2)
gh_fillet_2 = GHFillet(C=crv_2, R=number_slider_2)  # -> out, c; inputs C: Curve, R: Double
# ---------- gh_fillet_2: C# ----------
    // Written by @v-xup6

    // Fillet the sharp corners of a curve

    double tol = Rhino.RhinoDoc.ActiveDoc.ModelAbsoluteTolerance;
    double aTol = Rhino.RhinoDoc.ActiveDoc.ModelAngleToleranceRadians;
    c = Curve.CreateFilletCornersCurve(C, R, tol, aTol);
# ---------- end gh_fillet_2 ----------
panel_3 = Panel(fillet_2)
panel_4 = Panel(gh_fillet_2.c)

# ---- group: Flip Curve
crv_3 = Curve(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)
crv_4 = Curve(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)
gh_flip = GHFlipCurve(C=crv_3, G=crv_4)  # -> out, c, F; inputs C: Curve, G: Curve
# ---------- gh_flip: C# ----------
    // Written by @v=xup6
    
    // Flip a curve using an optional guide curve
    
    // Check vector angle between curve and guide curve
    // wrap in try catch in case there's no guide curve
    double angle = 0;
    try{
      Vector3d crvVec = C.PointAtEnd - C.PointAtStart;
      Vector3d guideVec = G.PointAtEnd - G.PointAtStart;
      angle = Vector3d.VectorAngle(crvVec, guideVec);
    }
    catch{
    }

    // If angle is bigger than 90 deg OR
    // if there's no guide curve, flip the curve
    if(angle >= 0.5 * Math.PI || G == null){
      C.Reverse();
      c = C;
      F = true;
      return;
    }
    else{
      // If direction of curve are the same, no need to flip
      c = C;
      F = false;
      return;
    }
# ---------- end gh_flip ----------
flip = FlipCurve(Curve=crv_3, Guide=crv_4)  # -> Curve, Flag
panel_5 = Panel(flip.Curve)
panel_6 = Panel(flip.Flag)
panel_7 = Panel(gh_flip.c)
panel_8 = Panel(gh_flip.F)

# ----
offset_l = OffsetCurveLoose(Distance=1)

# ---- group: Curve to Polyline
topoly = CurveToPolyline(ToleranceDistance=0, ToleranceAngle=0)  # -> Polyline, Segments

# ----
seam = Seam()
pcol = PolylineCollapse(Tolerance=1)  # -> Polyline, Count
project = Project(Direction=Vector(0, 0, 1))
redpline = Reduce(Tolerance=1)  # -> Polyline, Reduction
smoothpline = SmoothPolyline(Strength=1, Times=1)
gh_fillet_3 = GHFilletDistance(C=crv, D=number_slider)  # -> out, c; inputs C: Curve, D: Double; disabled
# ---------- gh_fillet_3: C# ----------
    // Written by @v-xup6

    // Fillet the sharp corners of a curve by distance

    // Get each segment of the curve and segment count
    Curve[] segments = C.DuplicateSegments();
    int count = segments.Length;

    if(count == 0) return;

    // Create list to store all fillets
    List<Curve> fillets = new List<Curve>();

    // Iterate thru segment pairs to see if fillet-able
    for(int i = 0;i < count;i++){
      // Get index of second line, if curve is periodic
      // last segment gets paired with first
      int i2 = i + 1;
      if(i2 == count){
        if(C.IsClosed) i2 = 0;
        else break;
      }

      // Test to see if the pair can create a fillet
      Arc test = Curve.CreateFillet(segments[i], segments[i2], D, 0, 0);
      bool fAble = test.IsValid;

      // Get lengths of the pair
      double length = segments[i].GetLength();
      double length2 = segments[i2].GetLength();

      // If fillet-able and there's enought length
      if(fAble && length > D && length2 > D){
        // Parameter of start and end of fillet
        double t0, t1;

        // Set new length for first segment
        // and find its parameter, point and tangent at the end
        length = length - D;
        segments[i].LengthParameter(length, out t0);
        Point3d start = segments[i].PointAt(t0);
        Vector3d tangent = segments[i].TangentAt(t0);
        // Shorten 1st segment to fit the fillet
        segments[i] = segments[i].Split(t0)[0];

        // Find parameter and point at new start of 2nd segment
        segments[i2].LengthParameter(D, out t1);
        Point3d end = segments[i2].PointAt(t1);
        // Shorten 2nd segment to fit the fillet
        segments[i2] = segments[i2].Split(t1)[1];

        // Create the fillet arc and store it as a curve
        Arc fillet = new Arc(start, tangent, end);
        fillets.Add(fillet.ToNurbsCurve());
      }
    }

    // Store segments together with fillets so they can be joined
    fillets.AddRange(segments);
    Curve[] crv = Curve.JoinCurves(fillets);

    // Output
    c = crv[0];
# ---------- end gh_fillet_3 ----------

# ---- group: Fillet
list = ValueList({"Closed": 0, "Open": 1}, selected="Closed")
t = Slider(0, range=0..1)
domain = Domain(Domain(536.6191752, 823.7800279))
domain_2 = Domain(Domain(546.8909817, 809.9442152))
number_slider_3 = Slider(10, range=0..10)
crv_5 = Curve(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)
crv_6 = Curve(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)
filter = StreamFilter(Gate=list, Stream0=domain, Stream1=domain_2)
filter_2 = StreamFilter(Gate=list, Stream0=crv_5, Stream1=crv_6)
remap = RemapNumbers(Value=t, Source=Domain(0, 1), Target=filter)  # -> Mapped, Clipped
crv_7 = Curve(filter_2)
gh_fillet_4 = GHFillet(C=crv_7, t=remap.Mapped, R=number_slider_3)  # -> out, c, tFil; inputs C: Curve, t: Double, R: Double
# ---------- gh_fillet_4: C# usings ----------
using System.Linq;
# ---------- gh_fillet_4: C# ----------
    // Written by @v-xup6

    // Fillet the sharp corners of a curve at a paramaeter

    // Variables to store where the closest fillet-able
    // corner parameter is, and how "far" it is from
    // user defined paramter
    double distance = double.MaxValue;
    double param = 0;

    // Find start and end parameter
    double t0 = C.Domain.Min;
    double t1 = C.Domain.Max;

    // If curve is closed, we have to consider the
    // fillet between the first and last curve segments
    if(C.IsClosed){
      // Find "distance" from user param to start/end param
      double toStart = Math.Abs(t0 - t);
      double toEnd = Math.Abs(t1 - t);
      // Use the one with a smaller "distance"
      // as start for comparisons
      if(toStart < toEnd){
        distance = toStart;
        param = t0;
      }
      else{
        distance = toEnd;
        param = t1;
      }
    }

    // Find all fillet-able corner parameters
    while(true){
      // Find first corner between t0 and end of curve
      // t0 is the start of curve on first iteration
      // output param of found corner to t0 for next iteration
      bool run = C.GetNextDiscontinuity(Continuity.G1_continuous, t0, t1, out t0);

      // If no fillet-able corner is found, exit while loop
      if(!run) break;

      // Find "distance" from this corner to user param
      double d = Math.Abs(t - t0);
      // If closer then previously found closest value
      // record this "distance" and the parameter
      if(d < distance){
        param = t0;
        distance = d;
      }
    }

    // Create fillet arc at closest corner
    Arc fillet = Curve.CreateFillet(C, C, R, param, param);

    // Find start and end param of fillet on original curve
    // use these param to isolate the segment that needs to
    // replaced with a fillet
    Point3d start = fillet.StartPoint;
    Point3d end = fillet.EndPoint;
    C.ClosestPoint(start, out t0);
    C.ClosestPoint(end, out t1);
    double[] split = {t0,t1};
    Curve[] segments = C.Split(split);

    // Convert array to list using LINQ for versatility
    List<Curve> curves = segments.ToList();

    // Check which curve segment is the segment to be replaced
    Point3d corner = C.PointAt(param);
    for(int i = 0; i < curves.Count; i++){
      // Find parameter of closest point on segment
      double p;
      curves[i].ClosestPoint(corner, out p);
      
      // If curve is periodic, treat start and end param as the same
      bool atSeam = false;
      if(C.IsClosed &&
        (p == C.Domain.Min || p == C.Domain.Max) &&
        (param == C.Domain.Min || param == C.Domain.Max)){
        atSeam = true;
      }
      
      // If this segment includes the parameter of the fillet
      if(p == param || atSeam){
        // Remove this segment
        // and add the fillet arc as replacement
        curves.RemoveAt(i);
        curves.Add(fillet.ToNurbsCurve());

        // Segment found, end check
        break;
      }
    }

    // Join curve segments into a single curve
    Curve[] curve = Curve.JoinCurves(curves);

    // Output
    c = curve;
    tFil = param;
# ---------- end gh_fillet_4 ----------
fillet_3 = Fillet(Curve=crv_7, Parameter=remap.Mapped, Radius=number_slider_3)  # -> Curve, Parameter
panel_9 = Panel(fillet_3.Curve)
panel_10 = Panel(gh_fillet_4.c)
panel_11 = Panel(fillet_3.Parameter)
panel_12 = Panel(gh_fillet_4.tFil)

# ---- group: Offset Curve
number_slider_4 = Slider(50, range=0..500)
number_slider_5 = Slider(10, range=0..10)
crv_8 = Curve([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])
gh_offset = CSharpScript(C=crv_8, D=number_slider_5, t=number_slider_4)  # -> out, crv, X, A, B; inputs C: Curve, D: Double, P: Plane, c: Int32, t: Double
# ---------- gh_offset: C# ----------
    // Written by @v-xup6

    // Offset a curve with a specified distance

    // Create default values
    bool unset = this.Component.Params.Input[1].VolatileDataCount == 0;
    bool corner = this.Component.Params.Input[3].VolatileDataCount == 0;
    if(P == null) P = Plane.WorldXY;
    if(unset) D = 1;
    if(corner) c = 1;

    double tol = Rhino.RhinoDoc.ActiveDoc.ModelAbsoluteTolerance;

    // Tried looking at if offset direction is related to derivatives
    // they're not related
    Vector3d[] deriv = C.DerivativeAt(t, 3);

    // Check relation to frame and perpendicular frame
    // no absolute relation either.
    // When curve is on XY plane: seems to offset in -X of perpFrame, except when the curve is a line
    // When curve is not on XY plane: seems to offset in -Y of frameAt
    // When curve is non-planar: makes no sense
    Plane pln, ppln;
    C.FrameAt(t, out pln);
    C.PerpendicularFrameAt(t, out ppln);

    X = deriv;
    A = pln;
    B = ppln;

    // Curve offset method is a move in Z of plane?
    crv = C.Offset(P, D, tol, (CurveOffsetCornerStyle) c);
# ---------- end gh_offset ----------
offset = OffsetCurve(Curve=crv_8, Distance=number_slider_5, Plane=PlaneXY(0, 0, 0), Corners=1)
eval = EvaluateCurve(Curve=crv_8, Parameter=number_slider_4)  # -> Point, Tangent, Angle
pln = Plane(gh_offset.B)
cull_i = CullIndex(List=gh_offset.X, Indices=0, Wrap=True)
pln_2 = Plane(gh_offset.A)
amp = Amplitude(Vector=cull_i, Amplitude=15)
vdisex = VectorDisplayEx(Point=graft(eval.Point), Vector=amp, Colour=[RGB(255, 0, 0), RGB(0, 128, 0), RGB(0, 0, 255)], Width=2)

# ---- group: Extend Curve
number_slider_6 = Slider(-20, range=-20..20)
number_slider_7 = Slider(20, range=-20..20)
list_2 = ValueList({"Line": 0, "Arc": 1, "Smooth": 2}, selected="Smooth")
crv_9 = Curve([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])
gh_ext = GHExtendCurve(C=crv_9, T=list_2, L0=number_slider_6, L1=number_slider_7)  # -> out, c; inputs C: Curve, T: Int32, L0: Double, L1: Double
# ---------- gh_ext: C# usings ----------
using Rhino.Runtime;
# ---------- gh_ext: C# ----------
    // Written by @v-xup6

    // Extend a curve by a specified distance

    Curve crv = C;
    if(L0 > 0 && !C.IsClosed){ // If extention value at start >0, extend curve
      crv = C.Extend(CurveEnd.Start, L0, (CurveExtensionStyle) T);
    }
    else if(L0 < 0){ // If extention value at start <0, shorten curve
      double t0;
      // Find parameter of new start point
      crv.LengthParameter(-L0, out t0);
      // Split curve at start point, retrieve the curve after the point
      crv = crv.Split(t0)[1];
    }
    if(L1 > 0 && !C.IsClosed){ // If extention value at end >0, extend curve
      crv = crv.Extend(CurveEnd.End, L1, (CurveExtensionStyle) T);
    }
    else if(L1 < 0){ // If extention value at end <0, shorten curve
      double t1;
      double l = crv.GetLength();
      // Find parameter of new end point
      crv.LengthParameter(l + L1, out t1);
      // Split curve at end point, retrieve the curve before the point
      crv = crv.Split(t1)[0];
    }

    // Output
    c = crv;
# ---------- end gh_ext ----------
ext = ExtendCurve(Curve=crv_9, Type=list_2, Start=number_slider_6, End=number_slider_7)
panel_13 = Panel(ext)
panel_14 = Panel(gh_ext.c)

# ---- group: Join Curves
toggle = BooleanToggle(False)
crv_10 = Curve([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])
gh_join = GHJoinCurves(C=crv_10, P=toggle)  # -> out, c; inputs C: list of Curve, P: Boolean
# ---------- gh_join: C# ----------
    // Written by @v-xup6

    // Join as many curves as possible
    
    double tol = Rhino.RhinoDoc.ActiveDoc.ModelAbsoluteTolerance;
    c = Curve.JoinCurves(C, tol, P);
# ---------- end gh_join ----------
join = JoinCurves(Curves=crv_10, Preserve=toggle)
panel_15 = Panel(join)
panel_16 = Panel(gh_join.c)

# ----
offsets = OffsetOnSrf(Distance=1)
pull = PullCurve()
fit = FitCurve()
reb = RebuildCurve(Count=10, Tangents=False)
simplify = SimplifyCurve()  # -> Curve, Simplified
gh_fillet_5 = GHFillet(C=crv_7, t=remap.Mapped, R=number_slider_3)  # -> out, c, tFil; inputs C: Curve, t: Double, R: Double; disabled
# ---------- gh_fillet_5: C# ----------
    // Written by @v-xup6

    // Fillet the sharp corners of a curve at a paramaeter

    double tol = Rhino.RhinoDoc.ActiveDoc.ModelAbsoluteTolerance;
    double aTol = Rhino.RhinoDoc.ActiveDoc.ModelAngleToleranceRadians;
    Curve[] segments = C.DuplicateSegments();
    int count = segments.Length;
    List<Arc> fillets = new List<Arc>();
    for(int i = 0;i < count;i++){
      int i2 = i + 1;
      if(i2 == count) i2 = 0;
      Arc fillet = Curve.CreateFillet(segments[i], segments[i2], R, t, t);
      if(fillet.IsValid) fillets.Add(fillet);
    }
    double distance = double.MaxValue;
    int index = -1;
    for(int i = 0;i < fillets.Count;i++){
      Point3d start = fillets[i].StartPoint;
      Point3d end = new Point3d();
      if(i == 0)end = fillets[fillets.Count - 1].EndPoint;
      else end = fillets[i - 1].EndPoint;
      double t0, t1;
      C.ClosestPoint(start, out t0);
      C.ClosestPoint(end, out t1);
      double d0 = Math.Abs(t0 - t);
      double d1 = Math.Abs(t - t1);
      bool prev = d1 < d0;
      double d = 0;
      if(prev) d = d1;
      else d = d0;
      if(d < distance){
        distance = d;
        if(prev){
          if(i == 0) index = fillets.Count - 1;
          else index = i - 1;
        }
        else index = i;
      }
    }

    Arc fil = fillets[index];
    double p0,p1;
    C.ClosestPoint(fil.StartPoint, out p0);
    C.ClosestPoint(fil.EndPoint, out p1);

    c = fil;
    tFil = (p0 + p1) / 2;
# ---------- end gh_fillet_5 ----------

# ---- group: Explode
toggle_2 = BooleanToggle(True)
# Curve Util
crv_11 = Curve([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])
gh_explode = GHExplode(C=crv_11, R=toggle_2)  # -> out, S, V; inputs C: Curve, R: Boolean
# ---------- gh_explode: C# ----------
    // Written by @v-xup6

    // Explode a curve into smaller segments

    // Explode to segments
    Curve[] segments = C.DuplicateSegments();

    // Convert to list for versatility
    List<Curve> seg = new List<Curve>();
    seg.AddRange(segments);

    // If no need to break down to atomic segments join lines
    if(!R){
      // List to store lines
      List<Curve> lines = new List<Curve>();

      // Variable to store if previous curve is a line
      // and how many lines are in the lines list
      int prevDeg = -1;
      int count = 0;

      // Loop thru in reverse order to avoid skips when item removed
      for(int i = segments.Length - 1;i >= 0;i--){
        // Check degree of current segment, 1 = line
        int deg = segments[i].Degree;

        // If current segment is a line
        if(deg == 1){
          // Add segment to lines list and update preDev
          lines.Add(segments[i]);
          prevDeg = deg;

          // If not last segment continue to next segment
          if(i != 0){
            count++;
            continue;
          }
        }

        // If at last segment OR
        // this segment is not a line and prev segment is a line
        if(prevDeg == 1){
          // Logic limits of removal and insertion
          // Remove count limit up to current segment (exclusive)
          int limit = 0;
          // Insert location default to after current segment
          int inIndex = i + 1;
          if(i == 0 && deg == 1){
            // If at last segment and it is a line, remove it too
            // insert location become current segment
            limit = -1;
            inIndex = i;
          }
          // Actually remove the lines
          for(int j = count; j > limit; j--){
            seg.RemoveAt(i + j);
          }
          // Join previously found lines and insert polyline to list
          Curve[] polyline = Curve.JoinCurves(lines);
          seg.Insert(inIndex, polyline[0]);
          // Reset count and list
          count = 0;
          lines = new List<Curve>();
        }

        // If current segment is not line, and previous also not line
        // OR current segment is not line, but previous is a line
        // OR last last segment, last iteration ergo doesn't matter

        // Update varible with degree from current segment
        prevDeg = deg;

        // Continue to next segment
      }
    }

    // Find verticies
    Point3d[] pt = new Point3d[seg.Count + 1];
    // Record start point for each segment
    for(int i = 0; i < seg.Count; i++){
      pt[i] = seg[i].PointAtStart;
    }
    // Add end point of curve
    pt[seg.Count] = C.PointAtEnd;

    // Output
    S = seg;
    V = pt;
# ---------- end gh_explode ----------
panel_17 = Panel(gh_explode.S)
panel_18 = Panel(gh_explode.V)

# ----
# GH#: A C# dictionary of Grasshopper3D components.
# 
# This file contains a category of Grasshopper components, and a mirroring C#/RhinoCommon implementation.
# 
# This is an educational project initiated by students/faculty of GSD-6338: Introduction to Computational Design, at the Harvard Graduate School of Design.
# 
# More information: {{project link}}
explode = Explode(Curve=crv_11, Recursive=toggle_2)  # -> Segments, Vertices

# ---- group: Explode (continued)
panel_19 = Panel(explode.Segments)
panel_20 = Panel(explode.Vertices)
