# Grasshopper definition Surface_Freeform.ghx (Grasshopper 1.0.7)

# ---- group: Grasshopper CPLoft
cploft = ControlPointLoft(Degree=5)

# ---- group: C# CP Loft
c_script = CSharpScript()  # -> Out, S

# ---- group: Grasshopper FitLoft
fitloft = FitLoft(CountU=15, DegreeU=5, DegreeV=5)

# ----
c_fitloft = CSharpScript()  # -> Out, S

# ---- group: Grasshopper Loft Opt
loft_opt = LoftOptions(Closed=False, Adjust=False, Rebuild=0, Refit=0, Type=0)

# ----
c_loft_opt = CSharpScript()  # -> Out, O

# ----
# GH#: A C# dictionary of Grasshopper3D components.
# 
# This file contains a category of Grasshopper components, and a mirroring C#/RhinoCommon implementation.
# 
# This is an educational project initiated by students/faculty of GSD-6338: Introduction to Computational Design, at the Harvard Graduate School of Design.
# 
# More information: {{project link}}
# Surface Freeform
# Surface Primitive Difficulties: Control Point Loft (CPLoft)
# Fit Loft (FitLoft)
# Loft Options (LoftOpt)
# Extrude Linear (Extrude)
# Extrude Along (ExtrCrv)
# Patch- inputs are not identical to Grasshopper -> result not identical.
# Fragment Patch (FPatch)- have not found something similar in Rhino Common.
# Variable Pipe (VPipe)- not identical to grasshopper component
pt = Point(Point(-5.736158344, -5.736158344, 0))
pt_2 = Point(Point(-5.736158344, 5.736158344, 0))
pt_3 = Point(Point(5.736158344, 5.736158344, 0))
pt_4 = Point(Point(5.736158344, -5.736158344, 0))
c_srf4pt = CSharpScript(A=pt, B=pt_2, C=pt_3, D=pt_4)  # -> out, S; inputs A: Point3d, B: Point3d, C: Point3d, D: Point3d
# ---------- c_srf4pt: C# ----------
    //Component written by @erinlinseyhunt

    //Create a nurbs surface from four corner points. The fifth input is a tolerance.
    NurbsSurface a = NurbsSurface.CreateFromCorners(A, B, C, D, 0.1);

    //Output
    S = a;
# ---------- end c_srf4pt ----------
geo = Geometry(c_srf4pt.S)

# ---- group: Grasshopper Srf4Pt
srf4pt = _4PointSurface(CornerA=pt, CornerB=pt_2, CornerC=pt_3, CornerD=pt_4)

# ----
geo_2 = Geometry(srf4pt)

crv = Curve(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)

# ---- group: Grasshopper Boundary Surface
boundary = BoundarySurfaces(Edges=crv)

# ---- group: C# Boundary Surface
c_script_2 = CSharpScript(E=crv)  # -> out, S; inputs E: list of Curve
# ---------- c_script_2: C# ----------
    //Component written by @erinlinseyhunt

    //Create a planar brep from a list of curves. The second input is the tolerance.
    Brep[] c = Brep.CreatePlanarBreps(E, 0.01);

    //Output
    S = c;
# ---------- end c_script_2 ----------

# ----
geo_3 = Geometry(boundary)
geo_4 = Geometry(c_script_2.S)

crv_2 = Curve(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)
crv_3 = Curve(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)
crv_4 = Curve(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)
crv_5 = Curve(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)
c_edgesrf = CSharpScript(A=crv_2, B=crv_3, C=crv_4, D=crv_5)  # -> out, S; inputs A: Curve, B: Curve, C: Curve, D: Curve
# ---------- c_edgesrf: C# ----------
    //Component written by @erinlinseyhunt

    //Create a new list of curves.
    List<Curve> E = new List<Curve>();


    //Add the four input curves to the new curve list using a for loop.
    for (int i = 0; i < 4; i++)
    {
      E.Add(A);
      E.Add(B);
      E.Add(C);
      E.Add(D);
    }

    //Creates a surface from a list of edge curves
    Brep b = Brep.CreateEdgeSurface(E);

    //Output
    S = b;
# ---------- end c_edgesrf ----------
geo_5 = Geometry(c_edgesrf.S)

# ---- group: Grasshopper EdgeSrf
edgesrf = EdgeSurface(CurveA=crv_2, CurveB=crv_3, CurveC=crv_4, CurveD=crv_5)

# ----
geo_6 = Geometry(edgesrf)

crv_6 = Curve(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)
crv_7 = Curve(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)
loft_types = Slider(2, range=0..5)

# ---- group: Grasshopper Loft
loft = Loft(Curves=[crv_6, crv_7], Options={Adjust=False, Closed=False, LoftEnds=0, LoftSimp=0, LoftType=0, Rebuild=10, Refit=0.01})

# ---- group: C# Loft
c_script_3 = CSharpScript(C=[crv_6, crv_7], O=loft_types)  # -> out, L; inputs C: list of Curve, O: Int32
# ---------- c_script_3: C# ----------
    //Component written by @erinlinseyhunt

    //Casting to LoftType
    //Normal (0), Loose (1), Tight (2), Straight (3), Developable (4), Uniform (5)
    LoftType LT = (LoftType) O;

    //Creating a loft from a list of points
    Brep[] loft = Brep.CreateFromLoft(C, Point3d.Unset, Point3d.Unset, 0, false);

    //Output
    L = loft;
# ---------- end c_script_3 ----------

# ----
geo_7 = Geometry(loft)
geo_8 = Geometry(c_script_3.L)

crv_8 = Curve([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])
crv_9 = Curve([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])
number_slider = Slider(2, range=0..100)

# ---- group: Grasshopper Network Surface
netsurf = NetworkSurface(CurvesU=crv_8, CurvesV=crv_9, Continuity=number_slider)

# ---- group: C# Network Surface
c_script_4 = CSharpScript(U=crv_8, V=crv_9, C=number_slider)  # -> out, S; inputs U: list of Curve, V: list of Curve, C: Int32
# ---------- c_script_4: C# ----------
    //Component written by @erinlinseyhunt

    //declaring
    int e;

    //Builds a surface from an ordered network of curves.
    NurbsSurface a = NurbsSurface.CreateNetworkSurface(U, C, C, V, C, C, 1.0, 1.0, 1.0, out e);

    //Output
    S = a;
# ---------- end c_script_4 ----------

# ----
geo_9 = Geometry(netsurf)
geo_10 = Geometry(c_script_4.S)

crv_10 = Curve(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)
crv_11 = Curve(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)

# ---- group: Grasshopper SumSrf
sumsrf = SumSurface(CurveA=crv_10, CurveB=crv_11)

# ---- group: C# SumSrf
c_script_5 = CSharpScript(A=crv_10, B=crv_11)  # -> out, S; inputs A: Curve, B: Curve
# ---------- c_script_5: C# ----------
    //Component written by @erinlinseyhunt

    //Creates a surface from two perpendicular curves.
    Surface C = SumSurface.Create(A, B);

    //Output
    S = C;
# ---------- end c_script_5 ----------

# ----
geo_11 = Geometry(sumsrf)
geo_12 = Geometry(c_script_5.S)

crv_12 = Curve(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)
distance = Slider(31, range=0..60)
Z = UnitZ(Factor=distance)

# ---- group: Grasshopper Extrude
extr = Extrude(Base=crv_12, Direction=Z)

# ---- group: C# Extrude
c_extr = CSharpScript(B=crv_12, D=Z)  # -> out, E; inputs B: Curve, D: Vector3d
# ---------- c_extr: C# ----------
    //Component written by @erinlinseyhunt

    //Create an extrusion from an input curve and a vector.
    Surface a = Surface.CreateExtrusion(B, D);

    //Output
    E = a;
# ---------- end c_extr ----------

# ----
geo_13 = Geometry(extr)
geo_14 = Geometry(c_extr.E)

geo_15 = Geometry()
xy = XYPlane(Origin=Point(0, 0, 0))
line = Line()
pln = Plane()
c_extrude = CSharpScript(Po=xy, A=line, Ao=pln)  # -> Out, E
geo_16 = Geometry(c_extrude.E)

# ---- group: Grasshopper Extrude
extrude = ExtrudeLinear(Profile=geo_15, OrientationP=xy, Axis=line, OrientationA=pln)

# ----
geo_17 = Geometry(extrude)

crv_13 = Curve([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])
number_slider_2 = Slider(40, range=0..50)
number_slider_3 = Slider(1.5, range=0..3)
c_patch = CSharpScript(C=crv_13, S=number_slider_2, F=number_slider_3)  # -> out, P; inputs C: list of Curve, S: Int32, F: Double
# ---------- c_patch: C# ----------
    //Component written by @erinlinseyhunt

    //Creates a patch from a list of curves, spans, and a flexibility low the number the less flexible.
    Brep a = Brep.CreatePatch(C, S, S, F);

    //Output
    P = a;
# ---------- end c_patch ----------
geo_18 = Geometry(c_patch.P)

# ---- group: Grasshopper Patch
patch = Patch(Curves=crv_13, Spans=number_slider_2, Flexibility=number_slider_3, Trim=True)

# ----
geo_19 = Geometry(patch)

crv_14 = Curve(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)
number_slider_4 = Slider(1, range=0..10)
number_slider_5 = Slider(1, range=0..2)
c_pipe = CSharpScript(C=crv_14, R=number_slider_4, E=number_slider_5)  # -> out, P; inputs C: Curve, R: Double, E: Int32
# ---------- c_pipe: C# ----------
    //Component written by @erinlinseyhunt

    //Casting to PipeCapMode
    PipeCapMode pcm = (PipeCapMode) E;

    //Creating a Pipe
    P = Brep.CreatePipe(C, R, true, pcm, true, 0.1, 0.1);
# ---------- end c_pipe ----------
geo_20 = Geometry(c_pipe.P)

# ---- group: Grasshopper Pipe
pipe = Pipe(Curve=crv_14, Radius=number_slider_4, Caps=number_slider_5)

# ----
geo_21 = Geometry(pipe)

crv_15 = Curve(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)
crv_16 = Curve(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)
toggle = BooleanToggle(False)
c_swp1 = CSharpScript(R1=crv_15, Section=crv_16, H=toggle)  # -> out, S; inputs R1: Curve, Section: Curve, H: Boolean
# ---------- c_swp1: C# ----------
    //Component written by @erinlinseyhunt

    //Creating a surface from a guide rail and a section curve.
    //If H is true, it creates a sweep with the same-height properties.
    Brep[] a = Brep.CreateFromSweep(R1, Section, H, 0.1);

    //Output
    S = a;
# ---------- end c_swp1 ----------
geo_22 = Geometry(c_swp1.S)

# ---- group: Grasshopper Swp1
swp1 = Sweep1(Rail=crv_15, Sections=crv_16, Miter=toggle)

# ----
geo_23 = Geometry(swp1)

crv_17 = Curve(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)
crv_18 = Curve(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)
line_2 = Line(Line((-0.9052572758, 2.262307137, 0), (-0.9052572758, 2.262307137, 3.845153002)))
toggle_2 = BooleanToggle(True)
c_railrev = CSharpScript(P=crv_17, R=crv_18, A=line_2, S=toggle_2)  # -> out, surface; inputs P: Curve, R: Curve, A: Line, S: Boolean
# ---------- c_railrev: C# ----------
    //Component written by @erinlinseyhunt
    
    //Create a surface of revolution using a sweep rail.
    //Inputs defined: P- Profile Curve, R- Rail Curve, A- Rovolution Axis, S- Scale Height of Profile Curve
    NurbsSurface a = NurbsSurface.CreateRailRevolvedSurface(P, R, A, S);
    
    //Output
    surface = a;
# ---------- end c_railrev ----------
geo_24 = Geometry(c_railrev.surface)

# ---- group: Grasshopper RailRev
railrev = RailRevolution(Curve=crv_17, Rail=crv_18, Axis=line_2, Scale=toggle_2)

# ----
geo_25 = Geometry(railrev)

pt_5 = Point([Point(3.502195346, -2.194951084, 0), Point(-2.704732184, -2.194951084, 0), Point(1.235859161, 2.304070851, 0), Point(-4.433958533, 2.304070851, 0)])
number_slider_6 = Slider(2, range=0..2)

# ---- group: Grasshopper SrfGrid
srfgrid = SurfaceFromPoints(Points=pt_5, UCount=number_slider_6, Interpolate=False)

# ---- group: C# SrfGrid
c_srf_grid = CSharpScript(P=pt_5, U=number_slider_6)  # -> out, S; inputs P: list of Point3d, U: Int32
# ---------- c_srf_grid: C# ----------
    //Component written by @erinlinseyhunt
    
    //Create a nurbs suface from a grid of points.
    NurbsSurface a = NurbsSurface.CreateFromPoints(P, U, U, U, U);
    
    //Output
    S = a;
# ---------- end c_srf_grid ----------

# ----
geo_26 = Geometry(srfgrid)
geo_27 = Geometry(c_srf_grid.S)

crv_19 = Curve(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)
crv_20 = Curve(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)
c_ruledsrf = CSharpScript(A=crv_19, B=crv_20)  # -> out, S; inputs A: Curve, B: Curve
# ---------- c_ruledsrf: C# ----------
    //Component written by @erinlinseyhunt

    //Creates a surface between two curves.
    NurbsSurface a = NurbsSurface.CreateRuledSurface(A, B);
    
    //Output
    S = a;
# ---------- end c_ruledsrf ----------
geo_28 = Geometry(c_ruledsrf.S)

# ---- group: Grasshopper RuledSrf
rulesrf = RuledSurface(CurveA=crv_19, CurveB=crv_20)

# ----
geo_29 = Geometry(rulesrf)

geo_30 = Geometry()
crv_21 = Curve()
c_extrcrv = CSharpScript(B=geo_30, C=crv_21)  # -> Out, E
geo_31 = Geometry(c_extrcrv.E)

# ---- group: Grasshopper ExtrCrv
extrcrv = ExtrudeAlong(Base=geo_30, Curve=crv_21)

# ----
geo_32 = Geometry(extrcrv)

crv_22 = Curve(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)
pt_6 = Point(Point(0, 0, 6))

# ---- group: Grasshopper Extrude Point
extr_2 = ExtrudePoint(Base=crv_22, Point=pt_6)

# ---- group: C# Extrude Point
c_extr_2 = CSharpScript(B=crv_22, P=pt_6)  # -> out, E; inputs B: Curve, P: Point3d
# ---------- c_extr_2: C# ----------
    //Component written by @erinlinseyhunt

    //Extrudes curves to a point
    Surface a = Surface.CreateExtrusionToPoint(B, P);

    //Output
    E = a;
# ---------- end c_extr_2 ----------

# ----
geo_33 = Geometry(extr_2)
geo_34 = Geometry(c_extr_2.E)

crv_23 = Curve()
c_fpatch = CSharpScript(B=crv_23)  # -> Out, P
geo_35 = Geometry(c_fpatch.P)

# ---- group: Grasshopper FPatch
fpatch = FragmentPatch(Boundary=crv_23)

# ----
geo_36 = Geometry(fpatch)

crv_24 = Curve(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)
genes = GenePool(Decimals=2, Maximum=1, Minimum=0, Value=[0, 0.5, 1])
genes_2 = GenePool(Decimals=2, Maximum=1, Minimum=0, Value=[1, 0.45, 1])
caps = Slider(2, range=0..2)
c_vpipe = CSharpScript(C=crv_24, t=genes, R=genes_2, E=caps)  # -> out, P; inputs C: Curve, t: list of Double, R: list of Double, E: Int32
# ---------- c_vpipe: C# ----------
    //Casting to PipeCapMode
    PipeCapMode pcm = (PipeCapMode) E;


    //List<int> mynewt = new List<int>();
    //for (int i = 0; i < t.Count; i++)
    //{
      //mynewt.Add;
    //}

    //Creating a Pipe
    P = Brep.CreatePipe(C, t, R, true, pcm, true, 0.1, 0.1);
# ---------- end c_vpipe ----------
geo_37 = Geometry(c_vpipe.P)

# ---- group: Grasshopper VPipe
vpipe = PipeVariable(Curve=crv_24, Parameters=genes, Radii=genes_2, Caps=caps)

# ----
geo_38 = Geometry(vpipe)

crv_25 = Curve(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)
crv_26 = Curve(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)
crv_27 = Curve(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)
toggle_3 = BooleanToggle(False)
c_swp2 = CSharpScript(R1=crv_26, R2=crv_25, Section=crv_27, H=toggle_3)  # -> out, S; inputs R1: Curve, R2: Curve, Section: Curve, H: Boolean
# ---------- c_swp2: C# ----------
    //Component written by @erinlinseyhunt

    //Creating a surface from two guide rails and a section curve.
    //If H is true, it creates a sweep with the same-height properties.
    Brep[] a = Brep.CreateFromSweep(R1, R2, Section, H, 0.1);
    
    //Output
    S = a;
# ---------- end c_swp2 ----------
geo_39 = Geometry(c_swp2.S)

# ---- group: Grasshopper Swp2
swp2 = Sweep2(Rail1=crv_25, Rail2=crv_26, Sections=crv_27, SameHeight=toggle_3)

# ----
geo_40 = Geometry(swp2)

crv_28 = Curve(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)
line_3 = Line(Line((-0.0149407726, -0.1708126088, 0), (-0.0149407726, -0.1708126088, 11.22436453)))
dom = ConstructDomain(DomainStart="0", DomainEnd="2*Pi")
c_revsrf = CSharpScript(P=crv_28, A=line_3, D1="0", D2="2*Pi")  # -> out, S; inputs P: Curve, A: Line, D1: Double, D2: Double
# ---------- c_revsrf: C# ----------
    //Component written by @erinlinseyhunt
    
    //Creates a surface of revolution using a profile (curve), a revolution axis (line), and a domain start and end. 
    Surface a = RevSurface.Create(P, A, D1, D2);
    
    //Output
    S = a;
# ---------- end c_revsrf ----------
geo_41 = Geometry(c_revsrf.S)

# ---- group: Grasshopper RevSrf
revsrf = Revolution(Curve=crv_28, Axis=line_3, Domain=dom)

# ----
geo_42 = Geometry(revsrf)
